# Grasshopper definition D6.4_framework.gh (Grasshopper 1.0.7)

# ---- group: POST-TENSIONED FRAME
f_bending_mpa = Panel("44")
lambda_diss = Slider(60, range=40..60)
e_steel_mpa = Panel("210000")
a_pt_mmq = Panel("150")
f_pt_mpa = Panel("1670")
e_pt_mpa = Panel("201000")
ratio_post_tension = Panel("0.62")
k_con = Slider(0.7, range=0..1)
copriferro = Slider(-0.05, range=-0.1..0.1)
e_timber_mpa = Panel("14000")
g_timber_mpa = Panel("600")
e_timber_perp_mpa = Panel("490")
f_yielding_mpa = Panel("355")
f_ultimate_mpa = Panel("510")
e_ultimate = Panel("0.06")
k_int_con = Slider(0.2, range=0..1)
k_foundation = Slider(0.55, range=0..1)

# ---- group: DDBD INPUT
theta_design_frames = Slider(1.7, range=1..2)
near_field = BooleanToggle(False)
damping_visc = Slider(3, range=1..10)
recentering = Slider(1.5, range=0..2)
theta_design_walls = Slider(1.2, range=0..3)
theta_sld = Slider(0.5, range=0..1)

# ---- group: POST-TENSIONED WALL
dist_bars = Slider(0.25, range=0..0.5)
n_diss = Slider(16, range=0..20)
diam_diss = Slider(24, range=0..30)
spacing_diss = Slider(0.2, range=0..0.5)
spacing_central_diss = Slider(1.9, range=0..3)
tension_bar = Panel("500")
f_bending_mpa_2 = Panel("24")
f_pt_bar_mpa = Panel("835")
e_pt_bar_mpa = Panel("205000")
n_bars = Slider(5, range=0..5)
a_pt_bar_mmq = Panel("1963.5")
e_timber_mpa_2 = Panel("11000")
g_timber_mpa_2 = Panel("690")

# ----
clt_layers_mm = Panel("""33
33
33
33
33
33
33
33
33""")

# ---- group: LOADS AND DENSITY
eq_density_slab_timber_kn_m3 = Panel("5.18")
eq_density_facade_x_kn_m3 = Panel("2.7")
eq_density_facade_y_kn_m3 = Panel("50")
density_timber_lvl_kn_m3 = Panel("4.8")
qk1_int = Slider(5, range=0..6)
g2_int = Slider(1.8, range=0..3)
g2_cop = Slider(0.8, range=0..3)
fi_comb_21 = Panel("0.6")

# ----
density_timber_clt_kn_m3 = Panel("4.2")

# ---- group: density facade layers_cladding X
density_int_insulation_kn_m3 = Panel("0.5")
density_ext_plaster_kn_m3 = Panel("15")
density_ext_insulation_kn_m3 = Panel("0.7")
density_internal_gypsum_board_kn_m3 = Panel("8.5")

# ----
density_concrete_slab_kn_m3 = Panel("25")

# ---- group: SPECTRUM
f0_slv = Panel("2.428")
ag_sld = Panel("0.075")
f0_sld = Panel("2.351")
ag_slv = Panel("0.19")
tc_slv = Panel("0.36")
soil = Panel("C")
tc_sld = Panel("0.328")

# ---- group: STRUCTURAL INPUTS
n_storey = Slider(3, range=0..10)
n_gravity_spans = Slider(3, range=0..10)
n_seismic_spans = Slider(6, range=0..10)
concrete_slab = Slider(0.08, range=0..0.1)
l_gravity_span = Slider(7, range=5..10)
l_seismic_span = Slider(7, range=5..10)
h_interstorey = Slider(3.6, range=0..10)
seismicbeam_h = Slider(0.6, range=0.5..0.9)
gravitybeam_b = Slider(0.5, range=0..1)
gravitybeam_h = Slider(0.8, range=0..1)
seismicbeam_b = Slider(0.405, range=0.2..0.8)
column_b = Slider(0.405, range=0.2..0.8)
column_h = Slider(0.6, range=0.5..1)
eq_thickness_timber_floor = Panel("0.104")
lw = Slider(3.5, range=0..10)
index_seismic_frames = Panel("""0
-1
1
2""")
ma = MassAddition(Input=clt_layers_mm)  # -> Result, PartialResults
division = Division(A=ma.Result, B="1000")
lng = ListLength(List=index_seismic_frames)  # -> flatten(Length)
python = GhPythonScript(layers=clt_layers_mm)  # -> b_net; inputs layers: list
# ---------- python: Python ----------
n = len(layers)

m = int(n/2)

remove = (m+1, m, m-1)

for index in remove:
    del layers[index]

b_net = sum(layers)/1000
# ---------- end python ----------

# ----
f_pt_u_mpa = Panel("1860")
e_ultimate_pt = Panel("0.01")

# ---- group: input facade
ext_insulation_mm = Panel("160")
int_finishing_mm = Panel("25")
single_glass_curtain_wall_mm = Panel("12")
air_gap_curtain_wall_mm = Panel("12")
ext_finishing_mm = Panel("10")
clt_panel_mm = Panel("83")
int_insulation_mm = Panel("40")
h_from_floor = Slider(1.2, range=0..3.6)
l_window = Slider(2.5, range=0..3)
h_window = Slider(1.6, range=0..3)

# ----
multiplication = Multiplication(A=density_ext_plaster_kn_m3, B="100")
multiplication_2 = Multiplication(A=density_timber_clt_kn_m3, B="100")
multiplication_3 = Multiplication(A=density_ext_insulation_kn_m3, B="100")
multiplication_4 = Multiplication(A=density_int_insulation_kn_m3, B="100")
multiplication_5 = Multiplication(A=density_internal_gypsum_board_kn_m3, B="100")
python_2 = GhPythonScript(statement=near_field)  # -> a
# ---------- python_2: Python ----------
__author__ = "Giada"
__version__ = "2022.04.27"

import rhinoscriptsyntax as rs

if statement:
    a = 0.25
    
else:
    a = 0.5
# ---------- end python_2 ----------
multiplication_6 = Multiplication(A=eq_density_slab_timber_kn_m3, B="100")
multiplication_7 = Multiplication(A=density_concrete_slab_kn_m3, B="100")
expression = Expression(x=recentering, Expression="x/(x + 1)")
panel = Panel(division)
division_2 = Division(A=int_finishing_mm, B="1000")
division_3 = Division(A=ext_finishing_mm, B="1000")
division_4 = Division(A=clt_panel_mm, B="1000")
division_5 = Division(A=int_insulation_mm, B="1000")
division_6 = Division(A=ext_insulation_mm, B="1000")
division_7 = Division(A=single_glass_curtain_wall_mm, B="1000")
python_3 = GhPythonScript(H_int=h_interstorey, n_floor=n_storey)  # -> H_floor
# ---------- python_3: Python ----------
H_floor = []

for i in range(int(n_floor)):
    
    H_floor.append((i + 1) * H_int)
# ---------- end python_3 ----------
gross_area = Multiplication(A=l_gravity_span, B=n_gravity_spans, C=l_seismic_span, D=n_seismic_spans, E=n_storey)
panel_2 = Panel(gross_area)

# ---- group: GEOMETRY / FACADES
ma_2 = MassAddition(Input=[ext_finishing_mm, ext_insulation_mm, clt_panel_mm, int_insulation_mm, int_finishing_mm])  # -> Result, PartialResults
division_8 = Division(A=seismicbeam_b, B="2")
division_9 = Division(A=l_window, B="2")
yz = YZPlane(Origin=Point(0, 0, 0))
division_10 = Division(A=ext_finishing_mm, B="1000")
division_11 = Division(A=int_finishing_mm, B="1000")
division_12 = Division(A=ext_insulation_mm, B="1000")
division_13 = Division(A=l_seismic_span, B="2")
division_14 = Division(A=clt_panel_mm, B="1000")
xz = XZPlane(Origin=Point(0, 0, 0))
division_15 = Division(A=int_insulation_mm, B="1000")
division_16 = Division(A=single_glass_curtain_wall_mm, B="1000")
division_17 = Division(A=air_gap_curtain_wall_mm, B="1000")
subtraction = Subtraction(A=n_seismic_spans, B="1")
subtraction_2 = Subtraction(A=n_storey, B="1")
division_18 = Division(A=gravitybeam_b, B="2")
division_19 = Division(A=column_h, B="2")
division_20 = Division(A=column_b, B="2")
subtraction_3 = Subtraction(A=n_storey, B="1")
xz_2 = XZPlane(Origin=Point(0, 0, 0))
subtraction_4 = Subtraction(A=n_gravity_spans, B="1")
division_21 = Division(A=ma_2.Result, B="1000")
addition = Addition(A=division_18, B=division)
facade_thickness = Panel(division_21)
recgrid = Rectangular(Plane=xz, SizeX=l_seismic_span, SizeY=h_interstorey, ExtentX=subtraction, ExtentY=subtraction_2)  # -> Cells, Points
recgrid_2 = Rectangular(Plane=yz, SizeX=l_gravity_span, SizeY=h_interstorey, ExtentX=subtraction_4, ExtentY=subtraction_3)  # -> Cells, Points
subtraction_5 = Subtraction(A=division_13, B=division_9)
multiplication_8 = Multiplication(A=l_seismic_span, B=n_seismic_spans)
multiplication_9 = Multiplication(A=l_gravity_span, B=n_gravity_spans)
rectangle = Rectangle(Plane=xz_2, XSize=division_19, YSize=h_interstorey, Radius=0)  # -> Rectangle, Length
rectangle_2 = Rectangle(Plane=xz_2, XSize=division_19, YSize=h_interstorey, Radius=0)  # -> Rectangle, Length
rectangle_3 = Rectangle(Plane=xz_2, XSize=division_19, YSize=h_interstorey, Radius=0)  # -> Rectangle, Length
rectangle_4 = Rectangle(Plane=xz_2, XSize=division_19, YSize=h_interstorey, Radius=0)  # -> Rectangle, Length
rectangle_5 = Rectangle(Plane=xz_2, XSize=division_19, YSize=h_interstorey, Radius=0)  # -> Rectangle, Length
rectangle_6 = Rectangle(Plane=xz, XSize=l_window, YSize=h_window, Radius=0)  # -> Rectangle, Length
vec = VectorXYZ(XComponent=subtraction_5, YComponent=0, ZComponent=h_from_floor)  # -> Vector, Length
division_22 = Division(A=multiplication_9, B="2")
division_23 = Division(A=multiplication_8, B="2")
move = Move(Geometry=rectangle_6.Rectangle, Motion=vec.Vector)  # -> Geometry, Transform
boxrec = BoxRectangle(Rectangle=rectangle_3.Rectangle, Height=division_15)
boxrec_2 = BoxRectangle(Rectangle=rectangle.Rectangle, Height=division_10)
boxrec_3 = BoxRectangle(Rectangle=rectangle_2.Rectangle, Height=division_14)
boxrec_4 = BoxRectangle(Rectangle=rectangle_4.Rectangle, Height=division_12)
boxrec_5 = BoxRectangle(Rectangle=rectangle_5.Rectangle, Height=division_11)
finestra = BoxRectangle(Rectangle=move.Geometry, Height=division_21)
pt = ConstructPoint(XCoordinate=division_23, YCoordinate=division_22, ZCoordinate=0)
addition_2 = Addition(A=division_15, B=division_11)
Y = UnitY(Factor=division_11)
rectangle_7 = Rectangle(Plane=xz, XSize=l_seismic_span, YSize=h_interstorey, Radius=0)  # -> Rectangle, Length
rectangle_8 = Rectangle(Plane=xz, XSize=l_seismic_span, YSize=h_interstorey, Radius=0)  # -> Rectangle, Length
rectangle_9 = Rectangle(Plane=xz, XSize=l_seismic_span, YSize=h_interstorey, Radius=0)  # -> Rectangle, Length
rectangle_10 = Rectangle(Plane=xz, XSize=l_seismic_span, YSize=h_interstorey, Radius=0)  # -> Rectangle, Length
rectangle_11 = Rectangle(Plane=xz, XSize=l_seismic_span, YSize=h_interstorey, Radius=0)  # -> Rectangle, Length
rectangle_12 = Rectangle(Plane=yz, XSize=l_gravity_span, YSize=h_interstorey, Radius=0)  # -> Rectangle, Length
rectangle_13 = Rectangle(Plane=yz, XSize=l_gravity_span, YSize=h_interstorey, Radius=0)  # -> Rectangle, Length
addition_3 = Addition(A=division_14, B=addition_2)
rev = Reverse(Vector=Y)
Y_2 = UnitY(Factor=addition_2)
addition_4 = Addition(A=division_12, B=addition_3)
move_2 = Move(Geometry=boxrec, Motion=rev)  # -> Geometry, Transform
Y_3 = UnitY(Factor=addition_3)
rev_2 = Reverse(Vector=Y_2)
boxrec_6 = BoxRectangle(Rectangle=rectangle_10.Rectangle, Height=division_15)
boxrec_7 = BoxRectangle(Rectangle=rectangle_7.Rectangle, Height=division_10)
boxrec_8 = BoxRectangle(Rectangle=rectangle_9.Rectangle, Height=division_14)
boxrec_9 = BoxRectangle(Rectangle=rectangle_8.Rectangle, Height=division_12)
boxrec_10 = BoxRectangle(Rectangle=rectangle_11.Rectangle, Height=division_11)
boxrec_11 = BoxRectangle(Rectangle=rectangle_12.Rectangle, Height=division_16)
boxrec_12 = BoxRectangle(Rectangle=rectangle_13.Rectangle, Height=division_16)
Y_4 = UnitY(Factor=addition_4)
rev_3 = Reverse(Vector=Y_3)
move_3 = Move(Geometry=boxrec_3, Motion=rev_2)  # -> Geometry, Transform
addition_5 = Addition(A=division_15, B=division_11)
addition_6 = Addition(A=division_16, B=division_16, C=division_17)
Y_5 = UnitY(Factor=division_11)
multiplication_10 = Multiplication(A=l_seismic_span, B=n_seismic_spans)
rev_4 = Reverse(Vector=Y_4)
move_4 = Move(Geometry=boxrec_4, Motion=rev_3)  # -> Geometry, Transform
addition_7 = Addition(A=division_14, B=addition_5)
rev_5 = Reverse(Vector=Y_5)
move_5 = Move(Geometry=boxrec_2, Motion=rev_4)  # -> Geometry, Transform
Y_6 = UnitY(Factor=addition_5)
vec_2 = VectorXYZ(XComponent=division_19, YComponent=division_20, ZComponent=0)  # -> Vector, Length
X = UnitX(Factor=division_16)
addition_8 = Addition(A=division_12, B=addition_7)
addition_9 = Addition(A=multiplication_10, B=division_19)
X_2 = UnitX(Factor=addition_6)
move_6 = Move(Geometry=boxrec_6, Motion=rev_5)  # -> Geometry, Transform
Y_7 = UnitY(Factor=addition_7)
rev_6 = Reverse(Vector=Y_6)
merge = Merge(Data1=move_5.Geometry, Data2=move_4.Geometry, Data3=move_3.Geometry, Data4=move_2.Geometry, Data5=boxrec_5)
rev_7 = Reverse(Vector=X)
Y_8 = UnitY(Factor=addition_8)
rev_8 = Reverse(Vector=X_2)
rev_9 = Reverse(Vector=Y_7)
move_7 = Move(Geometry=boxrec_8, Motion=rev_6)  # -> Geometry, Transform
rev_10 = Reverse(Vector=vec_2.Vector)
move_8 = Move(Geometry=boxrec_12, Motion=rev_7)  # -> Geometry, Transform
rev_11 = Reverse(Vector=Y_8)
move_9 = Move(Geometry=boxrec_9, Motion=rev_9)  # -> Geometry, Transform
move_10 = Move(Geometry=boxrec_11, Motion=rev_8)  # -> Geometry, Transform
move_11 = Move(Geometry=merge, Motion=rev_10)  # -> Geometry, Transform
X_3 = UnitX(Factor=addition_9)
move_12 = Move(Geometry=boxrec_7, Motion=rev_11)  # -> Geometry, Transform
move_13 = Move(Geometry=move_11.Geometry, Motion=X_3)  # -> Geometry, Transform
merge_2 = Merge(Data1=move_10.Geometry, Data2=move_8.Geometry)
X_4 = UnitX(Factor=addition)
merge_3 = Merge(Data1=move_12.Geometry, Data2=move_9.Geometry, Data3=move_7.Geometry, Data4=move_6.Geometry, Data5=boxrec_10)
rev_12 = Reverse(Vector=X_4)
Y_9 = UnitY(Factor=division_8)
merge_4 = Merge(Data1=move_13.Geometry, Data2=move_11.Geometry)
sdiff = SolidDifference(BrepsA=merge_3, BrepsB=finestra)
move_14 = Move(Geometry=merge_2, Motion=rev_12)  # -> Geometry, Transform
rev_13 = Reverse(Vector=Y_9)
cull_i = CullIndex(List=python_3, Indices="-1", Wrap=True)  # -> flatten(List)
move_15 = Move(Geometry=move_14.Geometry, Motion=graft(recgrid_2.Points))  # -> Geometry, Transform
move_16 = Move(Geometry=sdiff, Motion=rev_13)  # -> Geometry, Transform
Z = UnitZ(Factor=cull_i)
rotate = Rotate(Geometry=merge_4, Angle=degrees("180"), Plane=pt)  # -> Geometry, Transform
move_17 = Move(Geometry=move_16.Geometry, Motion=graft(recgrid.Points))  # -> Geometry, Transform
rotate_2 = Rotate(Geometry=move_15.Geometry, Angle=degrees("180"), Plane=pt)  # -> Geometry, Transform
merge_5 = Merge(Data1=merge_4, Data2=rotate.Geometry)  # -> graft(Result)
rotate_3 = Rotate(Geometry=move_17.Geometry, Angle=degrees("180"), Plane=pt)  # -> Geometry, Transform
curtain_wall_y = Merge(Data1=rotate_2.Geometry, Data2=move_15.Geometry)
move_18 = Move(Geometry=merge_5, Motion=Z)  # -> Geometry, Transform
facade_x = Merge(Data1=move_17.Geometry, Data2=rotate_3.Geometry)
angles = Merge(Data1=merge_5, Data2=move_18.Geometry)

# ---- group: GEOMETRY / STRUCTURE GEOMETRY
_3d_columns = _3DCOLUMNS(
    l_seismic_span=l_seismic_span,
    l_gravity_span=l_gravity_span,
    n_seismic_spans=n_seismic_spans,
    n_gravity_spans=n_gravity_spans,
    h_interstorey=h_interstorey,
    n_storey=n_storey,
    h_column=column_h,
    b_column=column_b)  # -> grid_columns, columns
_3d_seismic_beams = _3DSEISMICBEAMS(
    columns_grid=_3d_columns.grid_columns,
    h_floor=python_3,
    h_seismic_beam=seismicbeam_h,
    seismic_frames=index_seismic_frames,
    b_seismic_beam=seismicbeam_b,
    l_span=l_seismic_span,
    n_spans=n_seismic_spans,
    columns=_3d_columns.columns)
_3d_gravity_beams = _3DGRAVITYBEAMS(
    columns_grid=_3d_columns.grid_columns,
    b_gravity_beam=gravitybeam_b,
    l_gravity_beam=l_gravity_span,
    n_gravity_spans=n_gravity_spans,
    columns=_3d_columns.columns,
    h_gravity_beam=gravitybeam_h,
    h_floor=python_3,
    slab_thickness=concrete_slab)
_3d_walls = _3DWALLS(
    l_seismic_span=l_seismic_span,
    n_seismic_spans=n_seismic_spans,
    n_gravity_spans=n_gravity_spans,
    b_gravity_beam=gravitybeam_b,
    b_wall=division,
    l_gravity_span=l_gravity_span,
    l_wall=lw,
    h_interstorey=h_interstorey,
    n_floor=n_storey)
_3d_tcc_floors = _3DTCCFLOORS(
    l_seismic_span=l_seismic_span,
    n_seismic_spans=n_seismic_spans,
    l_gravity_span=l_gravity_span,
    n_gravity_spans=n_gravity_spans,
    h_floor=python_3,
    thickness_timber_slab=eq_thickness_timber_floor,
    thickness_slab=concrete_slab,
    B=gravitybeam_b,
    columns=_3d_columns.columns,
    gravity_beams=_3d_gravity_beams,
    seismic_beams=_3d_seismic_beams)
_3d_concrete_slab = _3DCONCRETESLAB(
    l_seismic_span=l_seismic_span,
    n_seismic_spans=n_seismic_spans,
    thickness_slab=concrete_slab,
    l_gravity_span=l_gravity_span,
    n_gravity_spans=n_gravity_spans,
    h_floor=python_3,
    b_gravity_beam=gravitybeam_b,
    thickness_slab_2=concrete_slab,
    columns=_3d_columns.columns,
    seismic_beams=_3d_seismic_beams)

# ---- group: ENERGY PERFORMANCE / material
opaquemat = HBOpaqueMaterial(name="Gypsum", thickness=division_2, conductivity="0.25", density=multiplication_5, spec_heat="1000")  # -> mat; plug-in component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
opaquemat_2 = HBOpaqueMaterial(name="Gypsum", thickness=division_2, conductivity="0.25", density=multiplication_5, spec_heat="1000")  # -> mat; plug-in component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
opaquemat_3 = HBOpaqueMaterial(name="CLT scala", thickness="0.2", conductivity="0.12", density=multiplication_2, spec_heat="1600")  # -> mat; plug-in component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
opaquemat_4 = HBOpaqueMaterial(name="Fiberglass", thickness=division_5, conductivity="0.04", density=multiplication_4, spec_heat="1020")  # -> mat; plug-in component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
opaquemat_5 = HBOpaqueMaterial(name="CLT", thickness=division_4, conductivity="0.12", density=multiplication_2, spec_heat="1600")  # -> mat; plug-in component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
opaquemat_6 = HBOpaqueMaterial(name="CLT walls", thickness=division, conductivity="0.12", density=multiplication_2, spec_heat="1600")  # -> mat; plug-in component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
opaquemat_7 = HBOpaqueMaterial(name="Rockwool", thickness=division_6, conductivity="0.033", density=multiplication_3, spec_heat="1030")  # -> mat; plug-in component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
opaquemat_8 = HBOpaqueMaterial(name="Lime plaster", thickness=division_3, conductivity="0.73", density=multiplication, spec_heat="970")  # -> mat; plug-in component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
opaquemat_9 = HBOpaqueMaterial(
    name="Timber floor",
    thickness=eq_thickness_timber_floor,
    conductivity="0.12",
    density=multiplication_6,
    spec_heat="1200")  # -> mat; plug-in component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
opaquemat_10 = HBOpaqueMaterial(name="Concrete floor", thickness=concrete_slab, conductivity="1.4", density=multiplication_7, spec_heat="880")  # -> mat; plug-in component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
opaquemat_11 = HBOpaqueMaterial(name="Isol-imperm roof", thickness=Slider(0.08, range=0..0.5), conductivity="0.035", density="100", spec_heat="1000")  # -> mat; plug-in component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
opaquemat_12 = HBOpaqueMaterial(name="Concrete grounf floor", thickness=Slider(0.5, range=0..1), conductivity="1.4", density="2500", spec_heat="880")  # -> mat; plug-in component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
shademat = HBShadeMaterial(name="Wooden shades", thickness="0.02", conductivity="0.14")  # -> mat; plug-in component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
opaquemat_13 = HBOpaqueMaterial(
    name="Timber floor finishing",
    thickness=Slider(0.08, range=0..0.5),
    conductivity="0.14",
    density="400",
    spec_heat="1200")  # -> mat; plug-in component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
windowmat = HBWindowMaterial(name="Window", u_factor="1.6", shgc="0.6")  # -> mat; plug-in component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
windowconstr = HBWindowConstruction(name="Window", materials=windowmat)  # -> constr; plug-in component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
opaqueconstr = HBOpaqueConstruction(name="Int floors", materials=[opaquemat_9, opaquemat_10, opaquemat_13])  # -> constr; plug-in component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
windowconstr_2 = HBWindowConstruction(name="Curtain walls Y", materials=windowmat)  # -> constr; plug-in component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
opaqueconstr_2 = HBOpaqueConstruction(name="CLT Y", materials=opaquemat_6)  # -> constr; plug-in component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
opaqueconstr_3 = HBOpaqueConstruction(name="Int floors ceiling", materials=[opaquemat_13, opaquemat_10, opaquemat_9])  # -> constr; plug-in component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
opaqueconstr_4 = HBOpaqueConstruction(name="Ext walls X", materials=[opaquemat_8, opaquemat_7, opaquemat_5, opaquemat_4, opaquemat_2])  # -> constr; plug-in component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
opaqueconstr_5 = HBOpaqueConstruction(name="Int walls", materials=[opaquemat_2, opaquemat_4, opaquemat])  # -> constr; plug-in component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
opaqueconstr_6 = HBOpaqueConstruction(name="Arredi", materials=opaquemat_13)  # -> constr; plug-in component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
windowconstrshd = HBWindowConstructionShade(name="Shaded windows", win_constr=windowconstr, shd_material=shademat, shd_location="exterior")  # -> constr; plug-in component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
opaqueconstr_7 = HBOpaqueConstruction(name="Ground floor", materials=[opaquemat_12, opaquemat_13])  # -> constr; plug-in component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
opaqueconstr_8 = HBOpaqueConstruction(name="Roof", materials=[opaquemat_8, opaquemat_11, opaquemat_10, opaquemat_9])  # -> constr; plug-in component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
opaqueconstr_9 = HBOpaqueConstruction(name="muri scala", materials=opaquemat_3)  # -> constr; plug-in component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

# ---- group: Masses
layers = Panel("""0
1
2
3
4""")
layers_1st_floor = Panel("""{0;0}
{0;1}
{0;2}
{0;3}
{0;4}""")
layers_2 = Panel("""0
1""")
seism_beam = ListItem(List=flatten(_3d_seismic_beams), Index="0", Wrap=True)
grav_beam = ListItem(List=flatten(_3d_gravity_beams), Index="0", Wrap=True)
wall = ListItem(List=flatten(_3d_walls), Index="0", Wrap=True)
floor_concr = ListItem(List=simplify(_3d_concrete_slab), Index="0", Wrap=True)
column = ListItem(List=_3d_columns.columns, Index="0", Wrap=True)
floor_area = Multiplication(A=l_gravity_span, B=n_gravity_spans, C=l_seismic_span, D=n_seismic_spans)
multiplication_11 = Multiplication(A=fi_comb_21, B=qk1_int)
floor_timber = ListItem(List=simplify(_3d_tcc_floors), Index="0", Wrap=True)
branch = TreeBranch(Tree=facade_x, Path="{0;0;0;0}", MaintainPaths=True)
branch_2 = TreeBranch(Tree=curtain_wall_y, Path="{0;0;0;0}", MaintainPaths=True)
angle = TreeItem(Tree=angles, Path=layers_1st_floor, Index=0, Wrap=True)
volume = Volume(Geometry=seism_beam)  # -> Volume, Centroid
volume_2 = Volume(Geometry=grav_beam)  # -> Volume, Centroid
volume_3 = Volume(Geometry=column)  # -> Volume, Centroid
volume_4 = Volume(Geometry=wall)  # -> Volume, Centroid
addition_10 = Addition(A=multiplication_11, B=g2_int)
volume_5 = Volume(Geometry=floor_concr)  # -> Volume, Centroid
glass_panel = ListItem(List=branch_2, Index=layers_2, Wrap=True)  # -> flatten(Item)
volume_6 = Volume(Geometry=floor_timber)  # -> Volume, Centroid
cladding_panel = ListItem(List=branch, Index=layers, Wrap=True)  # -> flatten(Item)
volume_7 = Volume(Geometry=angle)  # -> Volume, Centroid
addition_11 = Addition(A=n_seismic_spans, B="1")
lng_2 = ListLength(List=flatten(_3d_walls))  # -> flatten(Length)
multiplication_12 = Multiplication(A=volume_5.Volume, B=density_concrete_slab_kn_m3)
lng_3 = ListLength(List=_3d_columns.columns)  # -> flatten(Length)
seism_beam_1st_floor = Multiplication(A=volume.Volume, B=density_timber_lvl_kn_m3, C=n_seismic_spans, D=lng)
volume_8 = Volume(Geometry=glass_panel)  # -> Volume, Centroid
volume_9 = Volume(Geometry=cladding_panel)  # -> Volume, Centroid
multiplication_13 = Multiplication(A=volume_6.Volume, B=eq_density_slab_timber_kn_m3, C=n_seismic_spans)
ma_3 = MassAddition(Input=volume_7.Volume)  # -> Result, PartialResults
multiplication_14 = Multiplication(A=floor_area, B=addition_10)
multiplication_15 = Multiplication(A=floor_area, B=g2_cop)
grav_beam_1st_floor = Multiplication(A=volume_2.Volume, B=density_timber_lvl_kn_m3, C=n_gravity_spans, D=addition_11)
col_tot = Multiplication(A=volume_3.Volume, B=density_timber_lvl_kn_m3, C=lng_3)
multiplication_16 = Multiplication(A=volume_4.Volume, B=density_timber_clt_kn_m3, C=lng_2)
ma_4 = MassAddition(Input=volume_9.Volume)  # -> Result, PartialResults
ma_5 = MassAddition(Input=volume_8.Volume)  # -> Result, PartialResults
multiplication_17 = Multiplication(A=ma_3.Result, C="4")
division_24 = Division(A=multiplication_16, B=n_storey)
division_25 = Division(A=col_tot, B=n_storey)
multiplication_18 = Multiplication(A=ma_4.Result, B=n_seismic_spans, C=eq_density_facade_x_kn_m3, D="2")
multiplication_19 = Multiplication(A=ma_5.Result, B=n_gravity_spans, C=eq_density_facade_y_kn_m3, D="2")
mass_internal_floors_kn = Addition(
    A=multiplication_13,
    B=multiplication_12,
    C=multiplication_18,
    D=multiplication_19,
    E=seism_beam_1st_floor,
    F=grav_beam_1st_floor,
    G=division_25,
    H=division_24,
    I=multiplication_17,
    J=multiplication_14)
mass_roof_kn = Addition(
    A=multiplication_13,
    B=multiplication_12,
    C=seism_beam_1st_floor,
    D=grav_beam_1st_floor,
    E=division_25,
    F=division_24,
    G=multiplication_15)
m_roof_ton = Division(A=mass_roof_kn, B="10")
m_floors_ton = Division(A=mass_internal_floors_kn, B="10")
panel_3 = Panel(m_floors_ton)
panel_4 = Panel(m_roof_ton)

# ---- group: N COLUMNS
division_26 = Division(A=l_seismic_span, B="2")
division_27 = Division(A=l_gravity_span, B="2")
h_tot = Multiplication(H_int=h_interstorey, N_floor=n_storey)
vec_3 = VectorXYZ(XComponent=division_26, YComponent=division_27, ZComponent=0)  # -> Vector, Length
recgrid_3 = Rectangular(Plane=PlaneXY(0, 0, 0), SizeX=l_seismic_span, SizeY=l_gravity_span, ExtentX="1", ExtentY="1")  # -> Cells, Points
rectangle_14 = Rectangle(Plane=PlaneXY(0, 0, 0), XSize=l_seismic_span, YSize=l_gravity_span, Radius=0)  # -> Rectangle, Length
rev_14 = Reverse(Vector=vec_3.Vector)
move_19 = Move(Geometry=rectangle_14.Rectangle, Motion=rev_14)  # -> Geometry, Transform
move_20 = Move(Geometry=move_19.Geometry, Motion=recgrid_3.Points)  # -> Geometry, Transform
boxrec_13 = BoxRectangle(Rectangle=move_20.Geometry, Height=h_tot)  # -> simplify(graft(Box))
item = TreeItem(Tree=boxrec_13, Path="{1; 1}", Index=0, Wrap=True)
sint = SolidIntersection(BrepsA=flatten(_3d_seismic_beams), BrepsB=boxrec_13)
sint_2 = SolidIntersection(BrepsA=flatten(facade_x), BrepsB=boxrec_13)
sint_3 = SolidIntersection(BrepsA=flatten(curtain_wall_y), BrepsB=boxrec_13)
sint_4 = SolidIntersection(BrepsA=flatten(angles), BrepsB=boxrec_13)
sint_5 = SolidIntersection(BrepsA=flatten(_3d_columns.columns), BrepsB=boxrec_13)
sint_6 = SolidIntersection(BrepsA=flatten(_3d_gravity_beams), BrepsB=boxrec_13)
sint_7 = SolidIntersection(BrepsA=flatten(_3d_concrete_slab), BrepsB=boxrec_13)
sint_8 = SolidIntersection(BrepsA=flatten(_3d_tcc_floors), BrepsB=boxrec_13)
sint_9 = SolidIntersection(BrepsA=flatten(_3d_concrete_slab), BrepsB=boxrec_13)
area = Area(Geometry=sint_9)  # -> Area, Centroid
volume_10 = Volume(Geometry=_3d_walls)  # -> Volume, Centroid
volume_11 = Volume(Geometry=sint_2)  # -> Volume, Centroid
volume_12 = Volume(Geometry=sint_3)  # -> Volume, Centroid
volume_13 = Volume(Geometry=sint_4)  # -> Volume, Centroid
volume_14 = Volume(Geometry=sint_5)  # -> Volume, Centroid
volume_15 = Volume(Geometry=sint_8)  # -> Volume, Centroid
volume_16 = Volume(Geometry=sint_6)  # -> Volume, Centroid
volume_17 = Volume(Geometry=sint)  # -> Volume, Centroid
volume_18 = Volume(Geometry=sint_7)  # -> Volume, Centroid
ma_6 = MassAddition(Input=volume_16.Volume)  # -> Result, PartialResults
ma_7 = MassAddition(Input=volume_12.Volume)  # -> Result, PartialResults
ma_8 = MassAddition(Input=volume_17.Volume)  # -> Result, PartialResults
ma_9 = MassAddition(Input=volume_18.Volume)  # -> Result, PartialResults
ma_10 = MassAddition(Input=volume_11.Volume)  # -> Result, PartialResults
ma_11 = MassAddition(Input=volume_13.Volume)  # -> Result, PartialResults
ma_12 = MassAddition(Input=volume_14.Volume)  # -> Result, PartialResults
ma_13 = MassAddition(Input=volume_15.Volume)  # -> Result, PartialResults
division_28 = Division(A=area.Area, B="2")
item_2 = ListItem(List=flatten(volume_10.Volume), Index="0", Wrap=True)
nullrep = ReplaceNulls(Items=ma_10.Result, Replacements="0")  # -> Items, Count
nullrep_2 = ReplaceNulls(Items=ma_7.Result, Replacements="0")  # -> Items, Count
nullrep_3 = ReplaceNulls(Items=ma_11.Result, Replacements="0")  # -> Items, Count
nullrep_4 = ReplaceNulls(Items=ma_12.Result, Replacements="0")  # -> Items, Count
nullrep_5 = ReplaceNulls(Items=ma_6.Result, Replacements="0")  # -> Items, Count
nullrep_6 = ReplaceNulls(Items=ma_8.Result, Replacements="0")  # -> Items, Count
nullrep_7 = ReplaceNulls(Items=ma_9.Result, Replacements="0")  # -> Items, Count
nullrep_8 = ReplaceNulls(Items=ma_13.Result, Replacements="0")  # -> Items, Count
loads_g2_q = GhPythonScript(areas=division_28, n_floor=n_storey, Interstorey=addition_10, Roof=g2_cop)  # -> list; inputs areas: list
# ---------- loads_g2_q: Python ----------
import rhinoscriptsyntax as rs

if len(areas) == n_floor:
    loads = (Interstorey,) * int(n_floor - 1)
    loads += (Roof,)
    
else:
    loads = (Interstorey,) * 2 * int(n_floor - 1)
    loads += (Roof,) * 2 

N_column = sum(loads[i] * area for i, area in enumerate(areas))

print(N_column)
# ---------- end loads_g2_q ----------
multiplication_20 = Multiplication(A=nullrep.Items, B=eq_density_facade_x_kn_m3)
multiplication_21 = Multiplication(A=nullrep_2.Items, B=eq_density_facade_y_kn_m3)
multiplication_22 = Multiplication(A=nullrep_3.Items, B=eq_density_facade_x_kn_m3)
multiplication_23 = Multiplication(A=nullrep_4.Items, B=density_timber_lvl_kn_m3)
multiplication_24 = Multiplication(A=nullrep_5.Items, B=density_timber_lvl_kn_m3)
multiplication_25 = Multiplication(A=nullrep_7.Items, B=density_concrete_slab_kn_m3)
multiplication_26 = Multiplication(A=nullrep_6.Items, B=density_timber_lvl_kn_m3)
multiplication_27 = Multiplication(A=nullrep_8.Items, B=eq_density_slab_timber_kn_m3)
multiplication_28 = Multiplication(A=item_2, B=density_timber_clt_kn_m3)
n_columns = Addition(
    A=multiplication_20,
    B=multiplication_21,
    C=multiplication_22,
    D=multiplication_23,
    E=multiplication_24,
    F=multiplication_26,
    G=multiplication_25,
    H=multiplication_27,
    I=loads_g2_q)  # -> flatten(Result)
python_4 = GhPythonScript(N_column=n_columns)  # -> graft(N_ext), graft(N_int); inputs N_column: list
# ---------- python_4: Python ----------
N_ext = [N_column[0], N_column[2]]
N_int = [N_column[1], N_column[3]]
# ---------- end python_4 ----------
panel_5 = Panel(n_columns)
merge_6 = Merge(Data1=python_4.N_ext, Data2=python_4.N_int)
flatten = FlattenTree(Tree=python_4.N_ext, Path="{0}")
panel_6 = Panel(python_4.N_ext)
panel_7 = Panel(python_4.N_int)
python_5 = GhPythonScript(frames=lng, tree=merge_6, list=flatten)  # -> a; inputs frames: Int32, tree: tree, list: tree
# ---------- python_5: Python ----------
if frames > 2:
    a = tree
    
else:
    a = list
# ---------- end python_5 ----------
ext_columns_0_int_columns_1 = Panel(python_5)

# ---- group: ENERGY PERFORMANCE / Construction
interiorsubset = HBInteriorConstructionSubset(interior_wall=opaqueconstr_5, ceiling=opaqueconstr_3, interior_floor=opaqueconstr)  # -> interior_set; plug-in component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
exteriorsubset = HBExteriorConstructionSubset(exterior_wall=opaqueconstr_4, exterior_roof=opaqueconstr_8, exposed_floor=opaqueconstr_7)  # -> exterior_set; plug-in component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
subfacesubset = HBSubfaceSubset(window=windowconstr_2, operable=windowconstrshd)  # -> subface_set; plug-in component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
constructionset = HBConstructionSet(exterior_subset=exteriorsubset, interior_subset=interiorsubset, subface_subset=subfacesubset)  # -> constr_set; plug-in component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

# ----
lng_4 = ListLength(List=flatten(_3d_walls))
mass_list = GhPythonScript(mass_int=m_floors_ton, mass_top=m_roof_ton, n_floor=n_storey)  # -> console, mass_list
# ---------- mass_list: Python ----------
__author__ = "giada"
__version__ = "2022.09.07"

import rhinoscriptsyntax as rs

mass_list = [mass_int] * (int(n_floor) - 1) + [mass_top]
# ---------- end mass_list ----------
floor_mass_ton = Panel(mass_list.mass_list)

# ---- group: DDBD
setti = ImageSampler(
    FilePath="C:\Grasshopper_Plots\Setti\ADRS.png",
    Filter="Colour",
    Interpolate=False,
    Umax=1,
    Umin=0,
    Vmax=1,
    Vmin=0,
    Wrap=1)
ddbd_frames = GhPythonScript(
    H_int=h_interstorey,
    number_storey=n_storey,
    mass_int=mass_internal_floors_kn,
    mass_top=mass_roof_kn,
    damping=damping_visc,
    beta=expression,
    alpha=python_2,
    theta_SLV=theta_design_frames,
    theta_SLD=theta_sld,
    ag_SLV=ag_slv,
    F0_SLV=f0_slv,
    Tc_SLV=tc_slv,
    ag_SLD=ag_sld,
    F0_SLD=f0_sld,
    Tc_SLD=tc_sld,
    Soil=soil)  # -> Vb_SLD, Vb_SLV
# ---------- ddbd_frames: Python ----------
import csv
import subprocess

# import spectra as dictionary
spectrum_SLD = {
               'ag': float(ag_SLD),
               'F0': float(F0_SLD),
               'Tc_star': float(Tc_SLD)
               }
spectrum_SLV = {
               'ag': float(ag_SLV),
               'F0': float(F0_SLV),
               'Tc_star': float(Tc_SLV)
               }

# global fixed parameters
n = 40      # points to define the ADRS spectrum
max_T = 4.  # starting period T to interpolate 
theta_SLV = theta_SLV/100
theta_SLD = theta_SLD/100
damping = damping/100
m = int(number_storey)
g = 9.81
pi = 3.14
r_factor = 0.1

# util functions
def coeff_soil(ag, F0, Tc_star, soil = 'A', csi = 0.05):
    if soil == 'A':
        Ss = 1
        Cc = 1
        return Ss, Cc
        
    elif soil == 'B':
        Ss = max(1, min(1.2, 1.4 - 0.4*F0*ag))
        Cc = 1.1 * Tc_star**-0.2
        return Ss, Cc
    
    elif soil == 'C':
        Ss = max(1, min(1.5, 1.7 - 0.6*F0*ag))
        Cc = 1.05 * Tc_star**-0.33
        return Ss, Cc
    
    elif soil == 'D':
        Ss = max(0.9, min(1.8, 2.4 - 1.5*F0*ag))
        Cc = 1.25 * Tc_star**-0.5
        return Ss, Cc
    
    elif soil == 'E':
        Ss = max(1, min(1.6, 2. - 1.1*F0*ag))
        Cc = 1.15 * Tc_star**-0.4
        return Ss, Cc
    
    else:
        raise BaseException
    

def spectrum_acc(ag, F0, Tc_star, T, csi = 0.05, St = 1.0):
    Ss, Cc = coeff_soil(ag, F0, Tc_star, Soil)
    Tc = Tc_star * Cc
    Tb = Tc/3
    Td = 4.0 * ag + 1.6
    eta = max(0.55, (7/(2 + csi*100))**alpha)
    
    if (T >= 0) and (T < Tb):
        return ag * Ss * St * eta * F0 * (T/Tb + 1/(eta*F0) * (1 - T/Tb))
        
    elif (T >= Tb) and (T < Tc):
        return ag * Ss * St * eta * F0
    
    elif (T >= Tc) and (T < Td):
        return ag * Ss * St * eta * F0 * Tc/T
        
    else:
        return ag * Ss * St * eta * F0 * (Tc*Td)/(T**2)

def spectrum_disp(ag, F0, Tc_star, T, csi = 0.05, St = 1.0):
    return spectrum_acc(ag, F0, Tc_star, T, csi, St) * g * (T/(2*pi))**2

def find_Teff(Sd_obj, kargs):
    T_eff = max_T
    Sd_guess = spectrum_disp(T=T_eff, **kargs)
    residual = abs(Sd_obj - Sd_guess)
    counter = 0
    
    while (counter < 10) and (residual >= 0.001):
        T_eff = T_eff/Sd_guess * Sd_obj
        Sd_guess = spectrum_disp(T=T_eff, **kargs)
        residual = abs(Sd_obj - Sd_guess)
        counter = counter + 1
        
    return T_eff

# create masses vector
floor_masses = [mass_int] * (m - 1)
floor_masses.append(mass_top)

mass_tot = sum(floor_masses)

# create displacement profile
shape = list()
shape_linear = [j/float(m) for j in range(1, int(m + 1))]

if m <= 4:
    shape = shape_linear

else: 
    for j in range(1, int(m + 1)):
        shape.append(4./3 * (j/float(m)) * (1. - j/float(m) * 1./4))

# create H floor vector
floor_heights = [H_int * (a + 1) for a in range(m)]

# design SLD
    # SDOF
displacements_SLD = [height * theta_SLD for height in floor_heights]  

masses_delta = [mass * displacements_SLD[i] for i, mass in enumerate(floor_masses)]
masses_delta2 = [mass_delta * displacements_SLD[i] for i, mass_delta in enumerate(masses_delta)]
masses_delta_heights = [mass_delta * floor_heights[i] for i, mass_delta in enumerate(masses_delta)]

displacement_SDOF_SLD = sum(masses_delta2) / sum(masses_delta)
mass_SDOF_SLD = sum(masses_delta) / displacement_SDOF_SLD
height_SDOF_SLD = sum(masses_delta_heights) / sum(masses_delta)

    # Base Shear
T_eff_SLD = find_Teff(displacement_SDOF_SLD, spectrum_SLD)
K_eff_SLD = 4 * pi**2 * mass_SDOF_SLD/g * T_eff_SLD**-2
Vb_SLD = K_eff_SLD * displacement_SDOF_SLD
print(theta_SLD, displacement_SDOF_SLD, mass_SDOF_SLD, height_SDOF_SLD, T_eff_SLD, K_eff_SLD, Vb_SLD) 
# design SLV
    # SDOF
critical_storey =  theta_SLV * H_int/shape[0]
displacements_SLV = [storey_shape * critical_storey for storey_shape in shape]  

masses_delta = [mass * displacements_SLV[i] for i, mass in enumerate(floor_masses)]
masses_delta2 = [mass_delta * displacements_SLV[i] for i, mass_delta in enumerate(masses_delta)]
masses_delta_height = [mass_delta * floor_heights[i] for i, mass_delta in enumerate(masses_delta)]

displacement_SDOF_SLV = sum(masses_delta2) / sum(masses_delta)
mass_SDOF_SLV = sum(masses_delta) / displacement_SDOF_SLV
height_SDOF_SLV = sum(masses_delta_height) / sum(masses_delta)

    # Taglio alla Base
ductility = displacement_SDOF_SLV/displacement_SDOF_SLD
csi_hyst = (2 - 2*beta) * (ductility - 1) / (pi * ductility * (1 + r_factor*(ductility - 1)))
csi = ductility**-0.433 * damping + 0.65 * csi_hyst
spectrum_SLV['csi'] = csi
T_eff_SLV = find_Teff(displacement_SDOF_SLV, spectrum_SLV)
K_eff_SLV = 4 * pi**2 * mass_SDOF_SLV/g * T_eff_SLV**-2
Vb_SLV = K_eff_SLV * displacement_SDOF_SLV
print(theta_SLV, displacement_SDOF_SLV, mass_SDOF_SLV, height_SDOF_SLV, csi, T_eff_SLV, K_eff_SLV, Vb_SLV) 

## Output file for imgs
#with open('C:\Grasshopper_Plots\Telai\DDBD.csv', 'wb') as csvfile:
#    writer = csv.writer(csvfile, delimiter=',')
#    
#    disp = (0, displacement_SDOF_SLD, displacement_SDOF_SLV)
#    acc = (0, Vb_SLD/mass_SDOF_SLD, Vb_SLV/mass_SDOF_SLV)
#
#    writer.writerow(disp)
#    writer.writerow(acc)
#
## define T set values for plotting
#T_plot = [max_T/n * i for i in range(n)]
#waste, Cc_SLD = coeff_soil(soil=Soil, **spectrum_SLD)
#waste, Cc_SLV = coeff_soil(soil=Soil, **spectrum_SLV)
#T_plot.append(Cc_SLD * spectrum_SLD['Tc_star'])
#T_plot.append(Cc_SLV * spectrum_SLV['Tc_star'])
#T_plot.sort()
#T_plot = tuple(T_plot)
#
#with open('C:\Grasshopper_Plots\Telai\DampedSpectra.csv', 'wb') as csvfile:
#    writer = csv.writer(csvfile, delimiter=',')
#    
#    disp = tuple(spectrum_disp(T=T, **spectrum_SLV) for T in T_plot)
#    acc = tuple(spectrum_acc(T=T, **spectrum_SLV) for T in T_plot)
#
#    writer.writerow(disp + (disp[-1],))
#    writer.writerow(acc + (0,))
#
#spectrum_SLV['csi'] = 0.05
#with open('C:\Grasshopper_Plots\Telai\ElasticSpectra.csv', 'wb') as csvfile:
#    writer = csv.writer(csvfile, delimiter=',')
#    
#    disp = tuple(spectrum_disp(T=T, **spectrum_SLV) for T in T_plot)
#    acc = tuple(spectrum_acc(T=T, **spectrum_SLV) for T in T_plot)
#    
#    writer.writerow(disp + (disp[-1],))
#    writer.writerow(acc + (0,))
#with open('C:\Grasshopper_Plots\Telai\SLDSpectra.csv', 'wb') as csvfile:
#    writer = csv.writer(csvfile, delimiter=',')
#    
#    disp = tuple(spectrum_disp(T=T, **spectrum_SLD) for T in T_plot)
#    acc = tuple(spectrum_acc(T=T, **spectrum_SLD) for T in T_plot)
#    
#    writer.writerow(disp + (disp[-1],))
#    writer.writerow(acc + (0,))
#subprocess.call([r'C:\Grasshopper_Plots\script_run.bat'])
# ---------- end ddbd_frames ----------
ddbd_walls = GhPythonScript(
    H_int=h_interstorey,
    number_storey=n_storey,
    mass_int=mass_internal_floors_kn,
    mass_top=mass_roof_kn,
    damping=damping_visc,
    beta=expression,
    alpha=python_2,
    theta_SLV=theta_design_walls,
    theta_SLD=theta_sld,
    ag_SLV=ag_slv,
    F0_SLV=f0_slv,
    Tc_SLV=tc_slv,
    ag_SLD=ag_sld,
    F0_SLD=f0_sld,
    Tc_SLD=tc_sld,
    Soil=soil)  # -> Vb_SLD, Vb_SLV
# ---------- ddbd_walls: Python ----------
import csv
import subprocess

# import spectra as dictionary
spectrum_SLD = {
               'ag': float(ag_SLD),
               'F0': float(F0_SLD),
               'Tc_star': float(Tc_SLD)
               }
spectrum_SLV = {
               'ag': float(ag_SLV),
               'F0': float(F0_SLV),
               'Tc_star': float(Tc_SLV)
               }



# global fixed parameters
n = 40      
max_T = 4.  
theta_SLV = theta_SLV/100
theta_SLD = theta_SLD/100
damping = damping/100
m = int(number_storey)
g = 9.81
pi = 3.14
r_factor = 0.1

# util functions
def coeff_soil(ag, F0, Tc_star, soil = 'A', csi = 0.05):
    if soil == 'A':
        Ss = 1
        Cc = 1
        return Ss, Cc
        
    elif soil == 'B':
        Ss = max(1, min(1.2, 1.4 - 0.4*F0*ag))
        Cc = 1.1 * Tc_star**-0.2
        return Ss, Cc
    
    elif soil == 'C':
        Ss = max(1, min(1.5, 1.7 - 0.6*F0*ag))
        Cc = 1.05 * Tc_star**-0.33
        return Ss, Cc
    
    elif soil == 'D':
        Ss = max(0.9, min(1.8, 2.4 - 1.5*F0*ag))
        Cc = 1.25 * Tc_star**-0.5
        return Ss, Cc
    
    elif soil == 'E':
        Ss = max(1, min(1.6, 2. - 1.1*F0*ag))
        Cc = 1.15 * Tc_star**-0.4
        return Ss, Cc
    
    else:
        raise BaseException

def spectrum_acc(ag, F0, Tc_star, T, csi = 0.05, St = 1.0):
    Ss, Cc = coeff_soil(ag, F0, Tc_star, Soil)
    Tc = Tc_star * Cc
    Tb = Tc/3
    Td = 4.0 * ag + 1.6
    eta = max(0.55, (7/(2 + csi*100))**alpha)
    
    if (T >= 0) and (T < Tb):
        return ag * Ss * St * eta * F0 * (T/Tb + 1/(eta*F0) * (1 - T/Tb))
        
    elif (T >= Tb) and (T < Tc):
        return ag * Ss * St * eta * F0
    
    elif (T >= Tc) and (T < Td):
        return ag * Ss * St * eta * F0 * Tc/T
        
    else:
        return ag * Ss * St * eta * F0 * (Tc*Td)/(T**2)

def spectrum_disp(ag, F0, Tc_star, T, csi = 0.05, St = 1.0):
    return spectrum_acc(ag, F0, Tc_star, T, csi, St) * g * (T/(2*pi))**2

def find_Teff(Sd_obj, kargs):
    T_eff = max_T
    Sd_guess = spectrum_disp(T=T_eff, **kargs)
    residual = abs(Sd_obj - Sd_guess)
    counter = 0
    
    while (counter < 10) and (residual >= 0.001):
        T_eff = T_eff/Sd_guess * Sd_obj
        Sd_guess = spectrum_disp(T=T_eff, **kargs)
        residual = abs(Sd_obj - Sd_guess)
        counter = counter + 1
        
    return T_eff

# create mass vector
floor_masses = [mass_int] * (m - 1)
floor_masses.append(mass_top)

mass_tot = sum(floor_masses)

# create displacement profile
shape_linear = [j/float(m) for j in range(1, int(m + 1))]
shape = shape_linear

# create storey height vector
floor_heights = [H_int * (a + 1) for a in range(m)]

# design SLD
    # SDOF
displacements_SLD = [height * theta_SLD for height in floor_heights]  

masses_delta = [mass * displacements_SLD[i] for i, mass in enumerate(floor_masses)]
masses_delta2 = [mass_delta * displacements_SLD[i] for i, mass_delta in enumerate(masses_delta)]
masses_delta_heights = [mass_delta * floor_heights[i] for i, mass_delta in enumerate(masses_delta)]

displacement_SDOF_SLD = sum(masses_delta2) / sum(masses_delta)
mass_SDOF_SLD = sum(masses_delta) / displacement_SDOF_SLD
height_SDOF_SLD = sum(masses_delta_heights) / sum(masses_delta)

    # Base Shear
T_eff_SLD = find_Teff(displacement_SDOF_SLD, spectrum_SLD)
K_eff_SLD = 4 * pi**2 * mass_SDOF_SLD/g * T_eff_SLD**-2
Vb_SLD = K_eff_SLD * displacement_SDOF_SLD

# design SLV
    # SDOF
critical_storey =  theta_SLV * H_int/shape[0]
displacements_SLV = [storey_shape * critical_storey for storey_shape in shape]  

masses_delta = [mass * displacements_SLV[i] for i, mass in enumerate(floor_masses)]
masses_delta2 = [mass_delta * displacements_SLV[i] for i, mass_delta in enumerate(masses_delta)]
masses_delta_heights = [mass_delta * floor_heights[i] for i, mass_delta in enumerate(masses_delta)]

displacement_SDOF_SLV = sum(masses_delta2) / sum(masses_delta)
mass_SDOF_SLV = sum(masses_delta) / displacement_SDOF_SLV
height_SDOF_SLV = sum(masses_delta_heights) / sum(masses_delta)

    # Base Shear
ductility = displacement_SDOF_SLV/displacement_SDOF_SLD
csi_hyst = (2 - 2*beta) * (ductility - 1) / (pi * ductility * (1 + r_factor*(ductility - 1)))
csi = ductility**-0.433 * damping + 0.65 * csi_hyst
spectrum_SLV['csi'] = csi
T_eff_SLV = find_Teff(displacement_SDOF_SLV, spectrum_SLV)
K_eff_SLV = 4 * pi**2 * mass_SDOF_SLV/g * T_eff_SLV**-2
Vb_SLV = K_eff_SLV * displacement_SDOF_SLV
print(mass_SDOF_SLV)

## File output per immagini
#with open('C:\Grasshopper_Plots\Setti\DDBD.csv', 'wb') as csvfile:
#    writer = csv.writer(csvfile, delimiter=',')
#    
#    disp = (0, displacement_SDOF_SLD, displacement_SDOF_SLV)
#    acc = (0, Vb_SLD/mass_SDOF_SLD, Vb_SLV/mass_SDOF_SLV)
#
#    writer.writerow(disp)
#    writer.writerow(acc)
#
## define T set values for plotting
#T_plot = [max_T/n * i for i in range(n)]
#waste, Cc_SLD = coeff_soil(soil=Soil, **spectrum_SLD)
#waste, Cc_SLV = coeff_soil(soil=Soil, **spectrum_SLV)
#T_plot.append(Cc_SLD * spectrum_SLD['Tc_star'])
#T_plot.append(Cc_SLV * spectrum_SLV['Tc_star'])
#T_plot.sort()
#T_plot = tuple(T_plot)
#
#with open('C:\Grasshopper_Plots\Setti\DampedSpectra.csv', 'wb') as csvfile:
#    writer = csv.writer(csvfile, delimiter=',')
#    
#    disp = tuple(spectrum_disp(T=T, **spectrum_SLV) for T in T_plot)
#    acc = tuple(spectrum_acc(T=T, **spectrum_SLV) for T in T_plot)
#
#    writer.writerow(disp + (disp[-1],))
#    writer.writerow(acc + (0,))
#
#spectrum_SLV['csi'] = 0.05
#with open('C:\Grasshopper_Plots\Setti\ElasticSpectra.csv', 'wb') as csvfile:
#    writer = csv.writer(csvfile, delimiter=',')
#    
#    disp = tuple(spectrum_disp(T=T, **spectrum_SLV) for T in T_plot)
#    acc = tuple(spectrum_acc(T=T, **spectrum_SLV) for T in T_plot)
#    
#    writer.writerow(disp + (disp[-1],))
#    writer.writerow(acc + (0,))
#
#with open('C:\Grasshopper_Plots\Setti\SLDSpectra.csv', 'wb') as csvfile:
#    writer = csv.writer(csvfile, delimiter=',')
#    
#    disp = tuple(spectrum_disp(T=T, **spectrum_SLD) for T in T_plot)
#    acc = tuple(spectrum_acc(T=T, **spectrum_SLD) for T in T_plot)
#    
#    writer.writerow(disp + (disp[-1],))
#    writer.writerow(acc + (0,))
#
#subprocess.call([r'C:\Grasshopper_Plots\script_run.bat'])
# ---------- end ddbd_walls ----------
vb_sld_frames = Panel(ddbd_frames.Vb_SLD)
vb_slv_frames = Panel(ddbd_frames.Vb_SLV)
vb_sld_walls = Panel(ddbd_walls.Vb_SLD)
vb_slv_walls = Panel(ddbd_walls.Vb_SLV)
telai = ImageSampler(
    FilePath="C:\Grasshopper_Plots\Telai\ADRS.png",
    Filter="Colour",
    Interpolate=False,
    Umax=1,
    Umin=0,
    Vmax=1,
    Vmin=0,
    Wrap=1)
wall_forces = GhPythonScript(
    mass_top=mass_roof_kn,
    mass_int=mass_internal_floors_kn,
    H_int=h_interstorey,
    n_storey=n_storey,
    n_wall=lng_4,
    Vb_SLV=ddbd_walls.Vb_SLV)  # -> prints, simplify(OTM_global), simplify(OTM_wall), simplify(forces_wall)
# ---------- wall_forces: Python ----------
__author__ = "Giada"
__version__ = "2022.04.27"

import rhinoscriptsyntax as rs

# Global variables
m = int(n_storey)
incr_last_storey = 0.1

# Deformed shape
shape = tuple(j/float(m) for j in range(1, int(m + 1)))

storey_masses = (mass_int,) * (m - 1)
storey_masses += (mass_top,)

masses_delta = tuple(mass * shape[i] for i, mass in enumerate(storey_masses))
sum_masses_delta = sum(masses_delta)

# F distribution
distrib_shear = [mass_delta/sum_masses_delta * (1-incr_last_storey) for mass_delta in masses_delta]
distrib_shear[-1] += incr_last_storey

storey_forces = tuple(distrib_forces * Vb_SLV for distrib_forces in distrib_shear)
OTM_global = sum(H_int * (i + 1) * storey_force for i, storey_force in enumerate(storey_forces))
OTM_wall = OTM_global/n_wall
forces_wall = [force/n_wall for force in storey_forces]
# ---------- end wall_forces ----------
frame_forces_sld = GhPythonScript(
    mass_top=mass_roof_kn,
    mass_int=mass_internal_floors_kn,
    H_int=h_interstorey,
    L_span=l_seismic_span,
    n_storey=n_storey,
    n_frame=lng,
    n_span=n_seismic_spans,
    Vb=ddbd_frames.Vb_SLD,
    N_column=python_5,
    h_column=column_h,
    beta=expression)  # -> prints, simplify(OTM_global), simplify(M_beams); inputs N_column: list
# ---------- frame_forces_sld: Python ----------
# Global variables
m = int(n_storey)
incr_last_storey = 0.1
L_base = n_span * L_span
n_col = n_span + 1

# Data structure
N = {
    'leeward': N_column[0],
    'windward': N_column[0],
    'internal': N_column[1]
    }
print(N_column[0])
# Util Functions
def seismic_axial(OTM, Vb):
    return (OTM - 0.6*Vb*H_int)/L_base
    
def M_int_col(Vb, N):
    return (0.6 * Vb * H_int) / ((N['windward']/N['internal'] + N['leeward']/N['internal'] + n_col/beta - 2) * beta)
    
def M_ext_col(Vb, N, M_int_col):
    M_leeward = (N['leeward']/N['internal'] + 1/beta - 1) * beta * M_int_col
    M_windward = (N['windward']/N['internal'] + 1/beta - 1) * beta * M_int_col
    return M_windward, M_leeward

# deformed shape and masses
shape = tuple(j/float(m) for j in range(1, int(m + 1)))

floor_masses = (mass_int,) * (m - 1)
floor_masses += (mass_top,)

mass_tot = sum(floor_masses)

masses_delta = tuple(mass * shape[i] for i, mass in enumerate(floor_masses))
sum_masses_delta = sum(masses_delta)

# F distribution
distrib_shear = [mass_delta/sum_masses_delta * (1-incr_last_storey) for mass_delta in masses_delta]
distrib_shear[-1] += incr_last_storey

storey_forces = tuple(distrib_force * Vb for distrib_force in distrib_shear)
OTM_global = sum(H_int * (i + 1) * storey_force for i, storey_force in enumerate(storey_forces))
OTM_frame = OTM_global/n_frame
Vb_frame = Vb/n_frame

# Internal forces
N_seismic = seismic_axial(OTM_frame, Vb_frame)

N['windward'] -= N_seismic
N['leeward'] += N_seismic

    # Beams
storey_shear = (storey_forces[-1],)
once = True

for force in reversed(storey_forces):
    if once:
        once = not(once)
        continue
        
    storey_shear = (force + storey_shear[0],) + storey_shear

shear_tot = sum(storey_shear)

shear_beam = tuple(N_seismic * shear/shear_tot for shear in storey_shear)

M_beams = [shear * L_span/2 * (1 - h_column/L_span) for shear in shear_beam]

# Boh
print(OTM_global)
# ---------- end frame_forces_sld ----------
frame_forces_slv = GhPythonScript(
    mass_top=mass_roof_kn,
    mass_int=mass_internal_floors_kn,
    H_int=h_interstorey,
    L_span=l_seismic_span,
    n_storey=n_storey,
    n_frame=lng,
    n_span=n_seismic_spans,
    Vb=ddbd_frames.Vb_SLV,
    N_column=python_5,
    h_column=column_h,
    beta=expression)  # -> prints, simplify(OTM_global), simplify(M_beams), simplify(M_columns), simplify(N_column); inputs N_column: list
# ---------- frame_forces_slv: Python ----------
__author__ = "Giada"
__version__ = "2022.04.27"

import rhinoscriptsyntax as rs

# Global Variables
m = int(n_storey)
incr_last_storey = 0.1
L_base = n_span * L_span
n_col = n_span + 1

# Data structure
N = {
    'leeward': N_column[0],
    'windward': N_column[0],
    'internal': N_column[1]
    }

# Util Functions
def seismic_axial(OTM, Vb):
    return (OTM - 0.6*Vb*H_int)/L_base
    
def M_col_int(Vb, N):
    return (0.6 * Vb * H_int) / ((N['windward']/N['internal'] + N['leeward']/N['internal'] + n_col/beta - 2) * beta)
    
def M_col_ext(Vb, N, M_col_int):
    M_leeward = (N['leeward']/N['internal'] + 1/beta - 1) * beta * M_col_int
    M_windward = (N['windward']/N['internal'] + 1/beta - 1) * beta * M_col_int
    return M_windward, M_leeward

# deformed shape and masses
shape_linear = tuple(j/float(m) for j in range(1, int(m + 1)))

if m <= 4:
    shape = shape_linear

else: 
    shape = tuple(4./3 * ((j + 1)/float(m)) * (1. - (j + 1)/float(m) * 1./4) for j in range(m))

storey_masses = (mass_int,) * (m - 1)
storey_masses += (mass_top,)

mass_tot = sum(storey_masses)

masses_delta = tuple(mass * shape[i] for i, mass in enumerate(storey_masses))
sum_masses_delta = sum(masses_delta)

# F distribution
distrib_shear = [mass_delta/sum_masses_delta * (1-incr_last_storey) for mass_delta in masses_delta]
distrib_shear[-1] += incr_last_storey

storey_forces = tuple(distrib_force * Vb for distrib_force in distrib_shear)
OTM_global = sum(H_int * (i + 1) * storey_force for i, storey_force in enumerate(storey_forces))
OTM_frame = OTM_global/n_frame
Vb_frame = Vb/n_frame

# Internal forces
N_seismic = seismic_axial(OTM_frame, Vb_frame)

N['windward'] -= N_seismic
N['leeward'] += N_seismic

    # Columns
M_columns = {}

M_columns['internal'] = M_col_int(Vb_frame, N)
M_columns['windward'], M_columns['leeward'] = M_col_ext(Vb_frame, N, M_columns['internal'])

M_columns = [M_columns['windward'], M_columns['internal'], M_columns['leeward']]
N_column = [N['windward'], N['internal'], N['leeward']]

    # Beams
storey_shear = (storey_forces[-1],)
once = True

for force in reversed(storey_forces):
    if once:
        once = not(once)
        continue
        
    storey_shear = (force + storey_shear[0],) + storey_shear

shear_tot = sum(storey_shear)

shear_beam = tuple(N_seismic * shear/shear_tot for shear in storey_shear)

M_beams = [shear * L_span/2 * (1 - h_column/L_span) for shear in shear_beam]

# Boh
print(OTM_global)
# ---------- end frame_forces_slv ----------
otm_slv_frames = Panel(frame_forces_slv.OTM_global)
n_columns_slv = Panel(frame_forces_slv.N_column)
m_columns_slv = Panel(frame_forces_slv.M_columns)
m_beams_slv = Panel(frame_forces_slv.M_beams)
otm_global = Panel(wall_forces.OTM_global)
otm_wall = Panel(wall_forces.OTM_wall)
wall_forces_2 = Panel(wall_forces.forces_wall)
m_beams_sld = Panel(frame_forces_sld.M_beams)
otm_sld_frames = Panel(frame_forces_sld.OTM_global)
sld_verification = GhPythonScript(
    b_column=column_b,
    h_column=column_h,
    L_span=l_seismic_span,
    b_beam=seismicbeam_b,
    h_beam=seismicbeam_h,
    H_int=h_interstorey,
    M_beams=frame_forces_sld.M_beams,
    k_int=k_int_con,
    E_timber=e_timber_mpa,
    G_timber=g_timber_mpa,
    E_timber_perp=e_timber_perp_mpa)  # -> theta_elastic, T_pti; inputs M_beams: list
# ---------- sld_verification: Python ----------
# Data structure
timber = {
    'E': E_timber * 1000,
    'G': G_timber * 1000,
    'E_perp': E_timber_perp *1000
    }
    
beam = {
    'h': h_beam,
    'b': b_beam,
    'L': L_span - h_column,
    'A': h_beam * b_beam,
    'I': b_beam * h_beam**3 / 12
    }
    
column = {
    'h': h_column,
    'b': b_column,
    'A': h_column * b_column,
    'I': b_column * h_column**3 / 12
    }

# Global variables
alpha_cl = 1.5
alpha_ave = 0.85

# Initial post-tension
T_pti = tuple(3*M_beam/beam['h'] for M_beam in M_beams)

# Rotations
theta = list()

for i, M_beam in enumerate(M_beams):
    theta_b = M_beam/L_span * (beam['L']**2/(6*timber['E']*beam['I']) + 2*alpha_cl/(timber['G']*beam['A']))
    theta_c = 0.5 * M_beam * L_span/beam['L'] * (H_int/(6*timber['E']*column['I']) + 2*alpha_cl/(timber['G']*column['A']*H_int))
    theta_j = 3*M_beam/(2*alpha_ave*column['A']*beam['h']*timber['G'])
    theta_int = k_int *T_pti[i]*column['h']/(timber['E_perp'] * beam['h']**2 * beam['b']) * (1 - column['h']/L_span)
    theta.append(theta_b + theta_c + theta_j + theta_int)

theta_elastic = sum(M_beam * theta[i] for i, M_beam in enumerate(M_beams))/sum(M_beams)

# Boh
T_pti = list(T_pti)
# ---------- end sld_verification ----------
tpt_initial_sld = Panel(sld_verification.T_pti)
theta_elastic = Panel(sld_verification.theta_elastic)

# ---- group: QUICK DESIGN
quick_design_beams = GhPythonScript(
    Tpti_SLD=sld_verification.T_pti,
    M_beams=frame_forces_slv.M_beams,
    h_beam=seismicbeam_h,
    cop=copriferro,
    f_pt=f_pt_mpa,
    A_pt=a_pt_mmq,
    f_y=f_yielding_mpa,
    beta=expression,
    ratio_pt=ratio_post_tension)  # -> console, n_diss, d_diss, n_tendons, T_pti; inputs Tpti_SLD: list, M_beams: list
# ---------- quick_design_beams: Python ----------
__author__ = "giada"
__version__ = "2022.09.08"

import rhinoscriptsyntax as rs
from math import ceil

T_pti = list()
#As_min = list()
for i, M_t in enumerate(M_beams):
    M_pt = float(M_t) * float(beta)
    T_pti.append(M_pt / (0.9 * float(h_beam)/2))
#    M_s = M_t - M_pt
#    As_min.append(M_s * 10**3/(float(f_y) * (float(h_beam) - 2*float(cop))))

# Max between SLD e Quick Des
T_pti = [max(T_qd, float(T_SLD)) for T_qd, T_SLD in zip(T_pti, Tpti_SLD)]
# Max per singolo trefolo
T_max_pti = float(f_pt) * float(ratio_pt) * float(A_pt) * 10**-3
n_tendons = [ceil(pti/T_max_pti) for pti in T_pti]
# As pmin for lambda
M_pt_qd = [t_pt * 0.9 * float(h_beam)/2 for t_pt in T_pti]
As_min = [
    M_pt * (1-float(beta * 1.1))/float(beta * 1.1) * 10**3/(float(f_y) * (float(h_beam) - 2*float(cop))) 
    for M_pt in M_pt_qd
]
print(M_pt_qd)
n_diss = list()
d_diss = list()
steel_options = {
    'reinforcement': [
        '2f12',
        '2f14',
        '2f16',
        '3f14',
        '2f18',
        '3f16',
        '4f14',
        '2f20',
        '2f22',
        '3f18',
        '4f16',
        '2f24',
        '3f20',
        '4f18',
        '2f26',
        '3f22',
        '2f28',
        '4f20',
        '3f24',
        '4f22',
        '3f26',
        '4f24',
        '3f28',
        '4f26',
        '4f28'
    ],
    'As': [
        226.1,
        307.9,
        402.1,
        461.8,
        508.9,
        603.2,
        615.8,
        628.3,
        760.3,
        763.4,
        804.2,
        904.8,
        942.5,
        1017.9,
        1061.9,
        1140.4,
        1231.5,
        1256.6,
        1357.2,
        1520.5,
        1592.8,
        1809.6,
        1847.3,
        2123.7,
        2463
    ]
}

def remove_over(diss_dict, diss):
    to_be_removed = list()
    for i, reinforcement in enumerate(diss_dict['reinforcement']):
        if (float(reinforcement[-2:]) > diss) and (i not in to_be_removed):
            to_be_removed.append(i)
    for index in reversed(sorted(to_be_removed)):
        diss_dict['reinforcement'].pop(index)
        diss_dict['As'].pop(index)
    return diss_dict

max_diss = 28
for As in As_min:
    for j, As_d in enumerate(steel_options['As']):
        if As <= As_d:
            prev_max_diss = max_diss
            n_diss.append(float(steel_options['reinforcement'][j][0]))
            d_diss.append(float(steel_options['reinforcement'][j][-2:]))
            max_diss = min(d_diss[-1], max_diss)
            if max_diss < prev_max_diss:
               steel_options = remove_over(steel_options, max_diss)
            break
        elif j == len(steel_options['As']) - 1:
            raise ValueError('no reinforcement combination possible')

# remove_over(diss_dict, diss) - This function takes in a dictionary of reinforcement options (diss_dict) and a maximum permissible dissipation value (diss).
# It loops through the reinforcement list in the dictionary and checks if the dissipation value of each reinforcement is greater than the given diss.
# If yes, it adds the index of that reinforcement to a list called to_be_removed.
# After completing the loop, it loops through the to_be_removed list in reverse order and removes the corresponding items from the reinforcement and As lists of the diss_dict.
# Finally, it returns the updated diss_dict.
#
# The script defines a variable called max_diss and initializes it to a given value (28).
# It then iterates over a list called As_min.
# For each element As in As_min, it loops over the steel_options['As'] list and checks if the As value is less than or equal to the current element (As_d) of steel_options['As'].
# If it is, it appends the dissipation value of the current reinforcement (steel_options['reinforcement'][j]) to a list called n_diss and its last two characters to a list called d_diss.
# It then updates the value of max_diss as the minimum value between the last element of d_diss and the current value of max_diss.
#
# If the updated value of max_diss is less than the previous value of max_diss, it calls the remove_over function on steel_options with the updated value of max_diss.
#
# The loop breaks after the first As_d value that is greater than As is encountered.
# If no such value is encountered, it raises a ValueError with the message "no reinforcement combination possible".
#
# In summary, the script is selecting a reinforcement option from a given set of options based on a given maximum dissipation value,
# and removing any options that have a higher dissipation value than the updated maximum value during the selection process
# ---------- end quick_design_beams ----------
quick_design_columns = GhPythonScript(N_col=frame_forces_slv.N_column, M_col=frame_forces_slv.M_columns, h_col=column_h, cop=copriferro, f_y=f_yielding_mpa)  # -> console, n_diss, d_diss; inputs N_col: list, M_col: list
# ---------- quick_design_columns: Python ----------
__author__ = "giada"
__version__ = "2022.09.08"

import rhinoscriptsyntax as rs
from math import ceil

As_min = list()
for M_t, N_c in zip(M_col, N_col):
    M_s = float(M_t) - float(N_c) * 0.9 * float(h_col)/2
    As_min.append(M_s * 10**3/(float(f_y) * (float(h_col) - 2*float(cop))))

As_min = max(As_min)
steel_options = {
    'reinforcement': [
        '2f12',
        '2f14',
        '2f16',
        '3f14',
        '2f18',
        '3f16',
        '4f14',
        '2f20',
        '2f22',
        '3f18',
        '4f16',
        '2f24',
        '3f20',
        '4f18',
        '2f26',
        '3f22',
        '2f28',
        '4f20',
        '3f24',
        '4f22',
        '3f26',
        '4f24',
        '3f28',
        '4f26',
        '4f28'
    ],
    'As': [
        226.1,
        307.9,
        402.1,
        461.8,
        508.9,
        603.2,
        615.8,
        628.3,
        760.3,
        763.4,
        804.2,
        904.8,
        942.5,
        1017.9,
        1061.9,
        1140.4,
        1231.5,
        1256.6,
        1357.2,
        1520.5,
        1592.8,
        1809.6,
        1847.3,
        2123.7,
        2463
    ]
}

for j, As_d in enumerate(steel_options['As']):
    if As_min <= As_d:
        n_diss = float(steel_options['reinforcement'][j][0])
        d_diss = float(steel_options['reinforcement'][j][-2:])
        break

n_diss = [int(n_diss)] * 3
d_diss = [int(d_diss)] * 3
# ---------- end quick_design_columns ----------
t_pt_i = Panel(quick_design_beams.n_tendons)
t_pt_i_2 = Panel(quick_design_beams.T_pti)
panel_8 = Panel(quick_design_columns.n_diss)
panel_9 = Panel(quick_design_beams.n_diss)
panel_10 = Panel(quick_design_beams.d_diss)
panel_11 = Panel(quick_design_columns.d_diss)

# ---- group: DETAILED DESIGN AND VERIFICATION
slv_design_columns = GhPythonScript(
    N_column=frame_forces_slv.N_column,
    M_columns=frame_forces_slv.M_columns,
    theta_design=theta_design_frames,
    beta=expression,
    b_column=column_b,
    h_column=column_h,
    L_span=l_seismic_span,
    n_span=n_seismic_spans,
    b_beam=seismicbeam_b,
    h_beam=seismicbeam_h,
    H_int=h_interstorey,
    k_int=k_int_con,
    k_fond=k_foundation,
    cov_beam=copriferro,
    d_diss=quick_design_columns.d_diss,
    n_diss=quick_design_columns.n_diss,
    f_bending=f_bending_mpa,
    E_timber=e_timber_mpa,
    G_timber=g_timber_mpa,
    E_timber_perp=e_timber_perp_mpa,
    f_yielding=f_yielding_mpa,
    f_ultimate=f_ultimate_mpa,
    E_steel=e_steel_mpa,
    e_ultimate=e_ultimate,
    A_pt=a_pt_mmq,
    f_pt=f_pt_mpa,
    E_pt=e_pt_mpa,
    lambda_diss=lambda_diss)  # -> lambda_columns, diss_verification, timber_verification, moment_verification, OTM_recentering, OTM_dissipative, flatten(verification_global); inputs N_column: list, M_columns: list, d_diss: list, n_diss: list
# ---------- slv_design_columns: Python ----------
# Global fixed terms
pi = 3.14
e_steel_ultimate_test = 0.2
lambda_ = lambda_diss

# data structure
timber = {
    'fb': f_bending * 1000,
    'E': E_timber * 1000,
    'G': G_timber * 1000,
    'E_perp': E_timber_perp *1000,
    'ey': f_bending/E_timber/k_fond
    }
    
steel = {
    'fy': f_yielding * 1000,
    'fu': f_ultimate * 1000,
    'E': E_steel * 1000,
    'ey': f_yielding/E_steel,
    'eu': e_ultimate,
    'r': (f_ultimate - f_yielding)/(e_steel_ultimate_test - f_yielding/E_steel)/E_steel,
    'lambda': lambda_
    }

beam = {
    'h': h_beam,
    'b': b_beam,
    'cov': cov_beam,
    'L': L_span - h_column,
    'A': h_beam * b_beam,
    'I': b_beam * h_beam**3 / 12
    }
    
column = {
    'h': h_column,
    'b': b_column,
    'A': h_column * b_column,
    'I': b_column * h_column**3 / 12
    }
    
connections = list()
for i, _ in enumerate(M_columns):
    dct = {
        'n_diss': n_diss[i],
        'd_diss': d_diss[i] / 1000,
        'N': N_column[i],
        'A_diss': n_diss[i] * (d_diss[i] / 1000)**2 * pi/4,
        'y_diss': (cov_beam, (h_beam - cov_beam)),
        'y_tendons': (h_beam/2,),
        'E': timber['E']*k_fond
        }
    connections.append(dct)

# Global variables
alpha_cl = 1.5

# Elastic rotations
theta_elastic = list()
for M_column in M_columns:
    theta_b = M_column * H_int/(5 * timber['E'] * beam['I'])
    theta_s = alpha_cl * M_column / (0.6 * timber['G'] * column['A'] * H_int)
    theta_elastic.append(theta_b + theta_s)

# Theta design
theta_gap = tuple(theta_design * 0.01 - theta for theta in theta_elastic)

# Connection
def epsilon_steel(theta, y, connection):
    deltas = tuple(theta * (dist - y) for dist in connection['y_diss'])
    L_fuse = steel['lambda'] * connection['d_diss']/4
    return tuple(delta/L_fuse for delta in deltas)
    
def tension_steel(epsilon, connection):
    def _stress_steel(e):
        return abs(e)/e * min(abs(e) * steel['E'], abs(steel['fy'] * (1 + steel['r'] * (abs(e)/steel['ey'] - 1))))
    
    return tuple(_stress_steel(e) * connection['A_diss'] for e in epsilon)

def moment_steel(tension, connection, compression_center):
    return sum((y_diss - compression_center) * tension[i] for i, y_diss in enumerate(connection['y_diss']))

def moment_axial(connection, compression_center):
    return (column['h']/2 - compression_center) * connection['N']

def epsilon_timber(theta, y, connection):
    decomp = 2 * connection['N'] / (k_fond * timber['E'] * beam['b'] * beam['h']**2)
    return (3 * theta/(0.5 * H_int) + decomp) * y
    
def compression_timber(epsilon, y, connection):
    return 0.5 * beam['b'] * y * epsilon * connection['E']
    
    
verifications = list()
mom_res = list()

for i, connection in enumerate(connections):
    theta = theta_gap[i]

    y = beam['h']/3
    epsilon_timber_ = epsilon_timber(theta, y, connection)
    epsilon_steel_ = epsilon_steel(theta, y, connection)
    unbalance = connection['N'] + sum(tension_steel(epsilon_steel_, connection)) - compression_timber(epsilon_timber_, y, connection)
    counter = 0
    while (counter<=10) and (abs(unbalance) >= 1):
        epsilon_timber_ = epsilon_timber(theta, y, connection)
        epsilon_steel_ = epsilon_steel(theta, y, connection)
        unbalance = connection['N'] + sum(tension_steel(epsilon_steel_, connection)) - compression_timber(epsilon_timber_, y, connection)
        y_correction = unbalance/(beam['b'] * connection['E'] * epsilon_timber_)
        y += y_correction
        counter += 1
        
    compression_center = y/3
    M_steel = moment_steel(tension_steel(epsilon_steel_, connection), connection, compression_center)
    M_tendon = moment_axial(connection, compression_center)
        
    verification = {
        'dissipatori': tuple(epsilon/steel['eu'] for epsilon in epsilon_steel_),
        'timber': epsilon_timber_/(timber['fb']/timber['E']/k_fond),
        'lambda': M_tendon/M_steel,
        'M' : M_columns[i]/(M_steel + M_tendon)
        }
    
    moments = {
        'dissipative': M_steel,
        'recentering': M_tendon,
        'tot': M_steel + M_tendon
        }
        
    verifications.append(verification)
    mom_res.append(moments)


# Output 
lambda_columns = list()
diss_verification = list()
timber_verification = list()
tendons_verification = list()
moment_verification = list()

for verification in verifications:
    lambda_columns.append(verification['lambda'])
    diss_verification.append(max(abs(ver) for ver in verification['dissipatori']))
    timber_verification.append(verification['timber'])
    moment_verification.append(verification['M'])
    
# Output OTM
OTM_recentering = mom_res[0]['recentering'] + mom_res[-1]['recentering'] + mom_res[1]['recentering'] * (n_span-1)
OTM_dissipative = mom_res[0]['dissipative'] + mom_res[-1]['dissipative'] + mom_res[1]['dissipative'] * (n_span-1)

# Verifications
check_diss = sum(ver >= 1 for ver in diss_verification)
check_timber = sum(ver >= 1 for ver in timber_verification)
check_tendons = sum(ver >= 1 for ver in tendons_verification)
check_moment = sum(ver >= 1 for ver in moment_verification)
verification_global = (check_diss or check_timber or check_tendons or check_moment) == 0

#for moments in mom_res:
#    print(moments)
#
#for verification in verifications:
#    print(verification)
#print(epsilon_steel_)
# ---------- end slv_design_columns ----------
slv_design_setti = GhPythonScript(
    F_storey=wall_forces.forces_wall,
    OTM_wall=wall_forces.OTM_wall,
    N_wall=multiplication_28,
    theta_design=theta_design_walls,
    beta=expression,
    H_int=h_interstorey,
    L_wall=lw,
    b_wall=division,
    b_net=python,
    k_fond=k_foundation,
    n_bar=n_bars,
    T_bar=tension_bar,
    s_bar=dist_bars,
    n_diss=n_diss,
    d_diss=diam_diss,
    s_diss=spacing_diss,
    central_s_diss=spacing_central_diss,
    f_bending=f_bending_mpa_2,
    E_timber=e_timber_mpa_2,
    G_timber=g_timber_mpa_2,
    f_yielding=f_yielding_mpa,
    f_ultimate=f_ultimate_mpa,
    E_steel=e_steel_mpa,
    e_ultimate=e_ultimate,
    A_pt=a_pt_bar_mmq,
    f_pt=f_pt_bar_mpa,
    E_pt=e_pt_bar_mpa,
    lambda_diss=lambda_diss)  # -> lambda_wall, diss_verification, timber_verification, bars_verification, moment_verification, OTM_recentering, OTM_dissipative, flatten(verification_global), theta_elastic; inputs F_storey: list, n_bar: Int32, n_diss: Int32
# ---------- slv_design_setti: Python ----------
# Global fixed terms
pi = 3.14
e_steel_ultimate_test = 0.2
lambda_ = lambda_diss
y_min_diss = 0.5

# Data structure
timber = {
    'fb': f_bending * 1000,
    'E': E_timber * 1000,
    'G': G_timber * 1000,
    'ey': f_bending/E_timber/k_fond
    }
    
steel = {
    'fy': f_yielding * 1000,
    'fu': f_ultimate * 1000,
    'E': E_steel * 1000,
    'ey': f_yielding/E_steel,
    'eu': e_ultimate,
    'r': (f_ultimate - f_yielding)/(e_steel_ultimate_test - f_yielding/E_steel)/E_steel,
    'lambda': lambda_
    }
    
bars = {
    'f': f_pt,
    'A': A_pt * 10**-6,
    'E': E_pt * 1000,
    'ey': f_pt/E_pt
    }
    
wall = {
    'h': L_wall,
    'b': b_wall,
    'A': L_wall * b_wall,
    'I': b_wall * L_wall**3 / 12,
    'A_shear': L_wall * b_net
    }
    
connection = {
    'n_bar': n_bar,
    'T_pti': (T_bar,) * n_bar,
    'y_bar': tuple(L_wall/2 - (n_bar - 1) * s_bar/2 + s_bar * i for i in range(n_bar)),
    'n_diss': n_diss,
    'd_diss': d_diss * 0.001,
    'y_diss': tuple(L_wall/2 - ((n_diss/2 - 2) * s_diss + max(central_s_diss, s_diss))/2 + s_diss * i for i in range(int(n_diss/4))) + tuple(L_wall/2 + max(central_s_diss, s_diss)/2 + s_diss * i for i in range(int(n_diss/4))),
    'A_diss': d_diss**2 / 2 * pi * 10**-6,
    'E': timber['E'] * k_fond
    }

H_storey = tuple(H_int * (i + 1) for i, _ in enumerate(F_storey))

# Elastic rotations
theta_bending = 0
for i, force in enumerate(F_storey):
    theta_bending += (force * H_storey[i]**2 * (3*H_storey[-1] - H_storey[i])) / (6 * timber['E'] * wall['I'] * H_storey[-1])
    
V_storey = list()
V = 0
for force in F_storey:
    V += force
    V_storey.append(V)

theta_shear = sum(V_storey) * H_int / (timber['G'] * wall['A_shear'] * H_storey[-1])
theta_elastic = theta_bending + theta_shear

# Theta design
theta_gap = theta_design * 0.01 - theta_elastic

# Connection
def epsilon_steel(theta, y, connection):
    deltas = tuple(theta * (dist - y) for dist in connection['y_diss'])
    L_fuse = steel['lambda'] * connection['d_diss']/4
    return tuple(delta/L_fuse for delta in deltas)
    
def tension_steel(epsilon, connection):
    def _stress_steel(e):
        return e/max(10**-6,abs(e)) * min(abs(e) * steel['E'], abs(steel['fy'] * (1 + steel['r'] * (abs(e)/steel['ey'] - 1))))
    
    return tuple(_stress_steel(e) * connection['A_diss'] for e in epsilon)

def moment_steel(tension, connection, compression_center):
    return sum((y_diss - compression_center) * tension[i] for i, y_diss in enumerate(connection['y_diss']))

def epsilon_bars(theta, y, connection):
    initial_epsilon = tuple(T_pti/bars['A']/bars['E'] for T_pti in connection['T_pti'])
    deltas = tuple(theta * (dist - y) for dist in connection['y_bar'])
    L_unbonded = H_storey[-1]
    return tuple(delta/L_unbonded + initial_epsilon[i] for i, delta in enumerate(deltas))

def tension_bars(epsilon, connection):
    return tuple(e * bars['E'] * bars['A'] for e in epsilon)

def moment_bars(tension, connection, compression_center):
    return sum((y_ten - compression_center) * tension[i] for i, y_ten in enumerate(connection['y_bar']))

def epsilon_timber(theta, y, connection):
    decomp = 2 * sum(connection['T_pti']) / (k_fond * timber['E'] * wall['b'] * wall['h']**2)
    return (3 * theta/H_storey[-1] + decomp) * y
    
def compression_timber(epsilon, y, connection):
    return 0.5 * wall['b'] * y * epsilon * connection['E']
    
    
theta = theta_gap

y = wall['h']/3
epsilon_timber_ = epsilon_timber(theta, y, connection)
epsilon_steel_ = epsilon_steel(theta, y, connection)
epsilon_bars_ = epsilon_bars(theta, y, connection)
unbalance = sum(tension_bars(epsilon_bars_, connection)) + sum(tension_steel(epsilon_steel_, connection)) - compression_timber(epsilon_timber_, y, connection)
counter = 0
while (counter<=50) and (abs(unbalance) >= 1):
    epsilon_timber_ = epsilon_timber(theta, y, connection)
    epsilon_steel_ = epsilon_steel(theta, y, connection)
    epsilon_bars_ = epsilon_bars(theta, y, connection)
    unbalance = sum(tension_bars(epsilon_bars_, connection)) + sum(tension_steel(epsilon_steel_, connection)) - compression_timber(epsilon_timber_, y, connection) + N_wall
    y_correction = unbalance/(wall['b'] * connection['E'] * epsilon_timber_)
    y += y_correction
    counter += 1
    
compression_center = y/3
M_steel = moment_steel(tension_steel(epsilon_steel_, connection), connection, compression_center)
M_bars = moment_bars(tension_bars(epsilon_bars_, connection), connection, compression_center)
M_axial = N_wall * (wall['h']/2 - compression_center)
        
moments = {
    'dissipative': M_steel,
    'recentering': M_bars + M_axial,
    'tot': M_steel + M_bars + M_axial
    }

verification = {
    'dissipaters': [abs(epsilon)/steel['eu'] for epsilon in epsilon_steel_],
    'timber': epsilon_timber_/(timber['fb']/timber['E']/k_fond),
    'bars': [epsilon/bars['ey']/0.7 for epsilon in epsilon_bars_],
    'lambda': (M_bars + M_axial)/M_steel,
    'M' : OTM_wall/(M_steel + M_bars)
    }

lambda_wall = verification['lambda']
diss_verification = max(verification['dissipaters'])
timber_verification = verification['timber']
bars_verification = max(verification['bars'])
moment_verification = verification['M']
OTM_dissipative = moments['dissipative']
OTM_recentering = moments['recentering']

check_diss = diss_verification >= 1
check_verification = timber_verification >= 1
check_bars = bars_verification >=1
check_moment = moment_verification >= 1
check_geometric = min(connection['y_diss']) <= y_min_diss

verification_global = (check_diss or check_verification or check_bars or check_moment) == 0
print(connection['y_diss'])
print(theta_elastic)
# ---------- end slv_design_setti ----------
slv_design_beams = GhPythonScript(
    T_pti=quick_design_beams.T_pti,
    M_beams=frame_forces_slv.M_beams,
    theta_design=theta_design_frames,
    beta=expression,
    b_column=column_b,
    h_column=column_h,
    L_span=l_seismic_span,
    n_span=n_seismic_spans,
    b_beam=seismicbeam_b,
    h_beam=seismicbeam_h,
    H_int=h_interstorey,
    k_int=k_int_con,
    k_con=k_con,
    cov_beam=copriferro,
    n_tendons=quick_design_beams.n_tendons,
    d_diss=quick_design_beams.d_diss,
    n_diss=quick_design_beams.n_diss,
    f_bending=f_bending_mpa,
    E_timber=e_timber_mpa,
    G_timber=g_timber_mpa,
    E_timber_perp=e_timber_perp_mpa,
    f_yielding=f_yielding_mpa,
    f_ultimate=f_ultimate_mpa,
    E_steel=e_steel_mpa,
    e_ultimate=e_ultimate,
    A_pt=a_pt_mmq,
    f_pt=f_pt_mpa,
    E_pt=e_pt_mpa,
    lambda_diss=lambda_diss)  # -> lambda_beams, diss_verification, timber_verification, tendons_verification, moment_verification, OTM_recentering, OTM_dissipative, flatten(verification_global); inputs T_pti: list, M_beams: list, n_tendons: list, d_diss: list, n_diss: list
# ---------- slv_design_beams: Python ----------
# Global fixed parameters
pi = 3.14
m = len(M_beams)
e_steel_ultimate_test = 0.2
lambda_ = lambda_diss

# data structure
timber = {
    'fb': f_bending * 1000,
    'E': E_timber * 1000,
    'G': G_timber * 1000,
    'E_perp': E_timber_perp *1000,
    'ey': f_bending/E_timber/k_con
    }
    
steel = {
    'fy': f_yielding * 1000,
    'fu': f_ultimate * 1000,
    'E': E_steel * 1000,
    'ey': f_yielding/E_steel,
    'eu': e_ultimate,
    'r': (f_ultimate - f_yielding)/(e_steel_ultimate_test - f_yielding/E_steel)/E_steel,
    'lambda': lambda_
    }
    
tendon = {
    'f': f_pt,
    'A': A_pt * 10**-6,
    'E': E_pt * 1000,
    'ey': f_pt/E_pt
    }
    
beam = {
    'h': h_beam,
    'b': b_beam,
    'cov': cov_beam,
    'L': L_span - h_column,
    'A': h_beam * b_beam,
    'I': b_beam * h_beam**3 / 12
    }
    
column = {
    'h': h_column,
    'b': b_column,
    'A': h_column * b_column,
    'I': b_column * h_column**3 / 12
    }
    
connections = list()
for i, _ in enumerate(M_beams):
    dct = {
        'n_diss': n_diss[i],
        'd_diss': d_diss[i] / 1000,
        'n_pt': n_tendons[i],
        'T_pti': (T_pti[i],),
        'A_diss': n_diss[i] * (d_diss[i] / 1000)**2 * pi/4,
        'y_diss': (cov_beam, (h_beam - cov_beam)),
        'y_tendons': (h_beam/2,),
        'E': timber['E']*k_con
        }
    connections.append(dct)

# Global variables
alpha_cl = 1.5
alpha_ave = 0.85

# Elastic rotations
theta_elastic = list()
for M_beam in M_beams:
    theta_b = M_beam/L_span * (beam['L']**2/(6*timber['E']*beam['I']) + 2*alpha_cl/(timber['G']*beam['A']))
    theta_c = 0.5 * M_beam * L_span/beam['L'] * (H_int/(6*timber['E']*column['I']) + 2*alpha_cl/(timber['G']*column['A']*H_int))
    theta_j = 3*M_beam/(2*alpha_ave*column['A']*beam['h']*timber['G'])
    theta_elastic.append(theta_b + theta_c + theta_j)

theta_int = [k_int * T * column['h']/(timber['E_perp'] * beam['h']**2 * beam['b']) for T in T_pti]
    
# Theta design
shape = list()

if m <= 4:
    shape = [j/float(m) for j in range(1, m + 1)]

else: 
    for j in range(1, m + 1):
        shape.append(4./3 * (j/float(m)) * (1. - j/float(m) * 1./4))

critical_storey =  theta_design/100 * H_int/shape[0]
displacements = tuple(storey_shape * critical_storey for storey_shape in shape)
displacements = (0,) + displacements

theta_proj = list()
once = True
for i, _ in enumerate(displacements):
    if once:
        once = not(once)
        continue
    theta_proj.append((displacements[i] - displacements[i-1])/H_int)

theta_con = [(theta - theta_elastic[i])/(1 - column['h']/L_span) for i, theta in enumerate(theta_proj)]
theta_gap = tuple(theta - theta_int[i] for i, theta in enumerate(theta_con))

# Connection
def epsilon_steel(theta, y, connection):
    deltas = tuple(theta * (dist - y) for dist in connection['y_diss'])
    L_fuse = steel['lambda'] * connection['d_diss']/4
    return tuple(delta/L_fuse for delta in deltas)
    
def tension_steel(epsilon, connection):
    def _stress_steel(e):
        return abs(e)/e * min(abs(e) * steel['E'], abs(steel['fy'] * (1 + steel['r'] * (abs(e)/steel['ey'] - 1))))
    
    return tuple(_stress_steel(e) * connection['A_diss'] for e in epsilon)

def moment_steel(tension, connection, compression_center):
    return sum((y_diss - compression_center) * tension[i] for i, y_diss in enumerate(connection['y_diss']))

def epsilon_tendon(theta, y, connection):
    initial_epsilon = tuple(T_pti/(connection['n_pt'] * tendon['A'])/tendon['E'] for T_pti in connection['T_pti'])
    deltas = tuple(theta * (dist - y) * 2 * n_span for dist in connection['y_tendons'])
    L_unbonded = L_span * n_span + column['h']
    return tuple(delta/L_unbonded + initial_epsilon[i] for i, delta in enumerate(deltas))

def tension_tendon(epsilon, connection):
    return tuple(e * tendon['E'] * tendon['A'] * connection['n_pt'] for e in epsilon)

def moment_tendon(tension, connection, compression_center):
    return sum((y_ten - compression_center) * tension[i] for i, y_ten in enumerate(connection['y_tendons']))

def epsilon_timber(theta, y, connection):
    decomp = 2 * sum(connection['T_pti']) / (k_con * timber['E'] * beam['b'] * beam['h']**2)
    return (3 * theta/(0.5 * beam['L']) + decomp) * y
    
def compression_timber(epsilon, y, connection):
    return 0.5 * beam['b'] * y * epsilon * connection['E']
    
    
verifications = list()
mom_res = list()

for i, connection in enumerate(connections):
    theta = theta_gap[i]

    y = beam['h']/3
    epsilon_timber_ = epsilon_timber(theta, y, connection)
    epsilon_steel_ = epsilon_steel(theta, y, connection)
    epsilon_tendon_ = epsilon_tendon(theta, y, connection)
    unbalance = sum(tension_tendon(epsilon_tendon_, connection)) + sum(tension_steel(epsilon_steel_, connection)) - compression_timber(epsilon_timber_, y, connection)
    counter = 0
    while (counter<=10) and (abs(unbalance) >= 1):
        epsilon_timber_ = epsilon_timber(theta, y, connection)
        epsilon_steel_ = epsilon_steel(theta, y, connection)
        epsilon_tendon_ = epsilon_tendon(theta, y, connection)
        unbalance = sum(tension_tendon(epsilon_tendon_, connection)) + sum(tension_steel(epsilon_steel_, connection)) - compression_timber(epsilon_timber_, y, connection)
        y_correction = unbalance/(beam['b'] * connection['E'] * epsilon_timber_)
        y += y_correction
        counter += 1
        
    compression_center = y/3
    M_steel = moment_steel(tension_steel(epsilon_steel_, connection), connection, compression_center)
    M_tendon = moment_tendon(tension_tendon(epsilon_tendon_, connection), connection, compression_center)
        
    verification = {
        'dissipaters': tuple(epsilon/steel['eu'] for epsilon in epsilon_steel_),
        'timber': epsilon_timber_/(timber['fb']/timber['E']/k_con),
        'tendon': tuple(epsilon/tendon['ey']/0.7 for epsilon in epsilon_tendon_),
        'lambda': M_tendon/M_steel,
        'M' : M_beams[i]/(M_steel + M_tendon)
        }
    
    moments = {
        'dissipative': M_steel,
        'recentering': M_tendon,
        'tot': M_steel + M_tendon
        }
        
    verifications.append(verification)
    mom_res.append(moments)


# Output 
lambda_beams = list()
diss_verification = list()
timber_verification = list()
tendons_verification = list()
moment_verification = list()

for verification in verifications:
    lambda_beams.append(verification['lambda'])
    diss_verification.append(max(abs(ver) for ver in verification['dissipaters']))
    timber_verification.append(verification['timber'])
    tendons_verification.append(max(verification['tendon']))
    moment_verification.append(verification['M'])
    
# Output OTM
OTM_recentering = 2 * n_span * sum(moment['recentering'] for moment in mom_res)
OTM_dissipative = 2 * n_span * sum(moment['dissipative'] for moment in mom_res)

# Verification
check_diss = sum(ver >= 1 for ver in diss_verification)
check_timber = sum(ver >= 1 for ver in timber_verification)
check_tendons = sum(ver >= 1 for ver in tendons_verification)
check_moment = sum(ver >= 1 for ver in moment_verification)
verification_global = (check_diss or check_timber or check_tendons or check_moment) == 0

#for moments in mom_res:
#    print(moments)
#
#
#for verification in verifications:
#    print(verification)
#print(timber['fb']/timber['E']/k_con)
#print(epsilon_steel_)
# ---------- end slv_design_beams ----------
timber_check = Panel(slv_design_columns.timber_verification)
dissipatori_check = Panel(slv_design_columns.diss_verification)
lambda = Panel(slv_design_columns.lambda_columns)
momento_check = Panel(slv_design_columns.moment_verification)
verifiche = Panel(slv_design_beams.verification_global)
lambda_2 = Panel(slv_design_beams.lambda_beams)
dissipatori_check_2 = Panel(slv_design_beams.diss_verification)
timber_check_2 = Panel(slv_design_beams.timber_verification)
trefoli_check = Panel(slv_design_beams.tendons_verification)
momenti_check = Panel(slv_design_beams.moment_verification)
verifica_timber = Panel(slv_design_setti.timber_verification)
verifica_dissipatori = Panel(slv_design_setti.diss_verification)
verifiche_2 = Panel(slv_design_columns.verification_global)
verifica_barre = Panel(slv_design_setti.bars_verification)
momento_verifica = Panel(slv_design_setti.moment_verification)
verifiche_3 = Panel(slv_design_setti.verification_global)
verifiche_4 = Panel(slv_design_setti.theta_elastic)
division_29 = Division(A=slv_design_beams.OTM_recentering, B=slv_design_beams.OTM_dissipative)
division_30 = Division(A=slv_design_columns.OTM_recentering, B=slv_design_columns.OTM_dissipative)
ricentramento_travi = Panel(division_29)
ricentramento_pilastri = Panel(division_30)
ricentramento_setti = Panel(slv_design_setti.lambda_wall)
addition_12 = Addition(A=slv_design_beams.OTM_recentering, B=slv_design_columns.OTM_recentering)
addition_13 = Addition(A=slv_design_beams.OTM_dissipative, B=slv_design_columns.OTM_dissipative)
division_31 = Division(A=addition_12, B=addition_13)
frames_recentering_ratio = Panel(division_31)

# ----
path_output_fema = FilePath("C:\PHD\Progetti di ricerca\MULTICARE\deliverables\D6.4_resilience\preslam-ops-multicare\output\output_fema.csv")
path_code = FilePath("C:\PHD\Progetti di ricerca\MULTICARE\deliverables\D6.4_resilience\preslam-ops-multicare\")
path_waveforms = FilePath("C:\PHD\Progetti di ricerca\MULTICARE\deliverables\D6.4_resilience\preslam-ops-multicare\time_series\")
path_th = FilePath("C:\PHD\Progetti di ricerca\MULTICARE\deliverables\D6.4_resilience\preslam-ops-multicare\input\time_history.json")
path_intensities = FilePath("C:\PHD\Progetti di ricerca\MULTICARE\deliverables\D6.4_resilience\preslam-ops-multicare\input\intensities.json")

# ---- group: EXPORT AND RUN ANALYSES
path_tendon = FilePath("C:\PHD\Progetti di ricerca\MULTICARE\deliverables\ouput_gh\tendon.json")
path_timber = FilePath("C:\PHD\Progetti di ricerca\MULTICARE\deliverables\ouput_gh\timber.json")
# The user should specify the path where the input .json file will be stored for the analysis to run.
path_frame = FilePath("C:\PHD\Progetti di ricerca\MULTICARE\deliverables\ouput_gh\frames.json")
path_steel = FilePath("C:\PHD\Progetti di ricerca\MULTICARE\deliverables\ouput_gh\steel.json")
output_frame_file_to_json = GhPythonScript(
    masses=mass_list.mass_list,
    n_floors=n_storey,
    n_spans=n_seismic_spans,
    storey=h_interstorey,
    span=l_seismic_span,
    n_frames=n_gravity_spans,
    axial_load=python_5,
    cop=copriferro,
    beam_b=seismicbeam_b,
    beam_h=seismicbeam_h,
    column_b=column_b,
    column_h=column_h,
    k_con_b=k_con,
    k_con_fond=k_foundation,
    beam_reinforcement_n=quick_design_beams.n_diss,
    beam_reinforcement_d=quick_design_beams.d_diss,
    col_reinforcement_n=quick_design_columns.n_diss,
    col_reinforcement_d=quick_design_columns.d_diss,
    n_tendons_beam=quick_design_beams.n_tendons,
    pt_tendons_beam=quick_design_beams.T_pti,
    path=path_frame)  # -> console, dict_json, output_file; inputs masses: list, axial_load: list, beam_reinforcement_n: list, beam_reinforcement_d: list, col_reinforcement_n: list, col_reinforcement_d: list, n_tendons_beam: list, pt_tendons_beam: list
# ---------- output_frame_file_to_json: Python ----------
__author__ = "giada"
__version__ = "2022.09.07"

import rhinoscriptsyntax as rs
import json

def export_to_json(filepath, data):
    with open(filepath, 'w') as jsonfile:
        json.dump(data, jsonfile, ensure_ascii=False, indent=4)

# initialize
masses = [float(mass) for mass in masses]
n_tendons_beam = [int(n_ten) for n_ten in n_tendons_beam]
pt_tendons_beam = [int(pt_ten) for pt_ten in pt_tendons_beam]
beam_reinforcement_n = [int(num) for num in beam_reinforcement_n]
beam_reinforcement_d = [int(diam) for diam in beam_reinforcement_d]


# dictionary
frame = {
    'masses': masses,
    'storey_height': float(storey),
    'span_length': float(span),
    'n_storeys': int(n_floors),
    'n_spans': int(n_spans),
    'n_frames': int(n_frames),
    'sections': dict()
}

# section_column
int_col = {
    'n_tendons': 0,
    'tendons_pt': 0,
    'axial_load': round(axial_load[1]),
    'top_reinforcement_depth': float(cop),
    'b': float(column_b),
    'h': float(column_h),
    'connection_stiffness_ratio': float(k_con_fond),
    'reinforcement_diameter': int(col_reinforcement_d[1]),
    'reinforcement_count': int(col_reinforcement_n[1])
}

#assert not((col_reinforcement_d[0] == col_reinforcement_d[-1]) and 
#           (col_reinforcement_n[0] == col_reinforcement_n[-1])),
#           'THE EXTERNAL COLUMNS MUST HAVE SAME REINFORCEMENT'
           
ext_col = {
    'n_tendons': 0,
    'tendons_pt': 0,
    'axial_load': round(axial_load[0]),
    'top_reinforcement_depth': float(cop),
    'b': float(column_b),
    'h': float(column_h),
    'connection_stiffness_ratio': float(k_con_fond),
    'reinforcement_diameter': int(col_reinforcement_d[0]),
    'reinforcement_count': int(col_reinforcement_n[0])
}

frame['sections']['internal_column'] = int_col
frame['sections']['external_column'] = ext_col

# beam_sections
beams = list()
for i, _ in enumerate(masses):
    beam = {
        'n_tendons': n_tendons_beam[i],
        'tendons_pt': pt_tendons_beam[i],
        'axial_load': 0,
        'top_reinforcement_depth': float(cop),
        'b': float(beam_b),
        'h': float(beam_h),
        'connection_stiffness_ratio': float(k_con_b),
        'reinforcement_diameter': beam_reinforcement_d[i],
        'reinforcement_count': beam_reinforcement_n[i]
    }
    beams.append(beam)

frame['sections']['beams'] = beams


export_to_json(
    path,
    frame
)

output_file = path
# ---------- end output_frame_file_to_json ----------
panel_12 = Panel(output_frame_file_to_json.output_file)
output_steel_file_to_json = GhPythonScript(name="steel dissipaters", fy=f_yielding_mpa, fu=f_ultimate_mpa, E=e_steel_mpa, epsilon_u=e_ultimate, path=path_steel)  # -> console, dict_json, output_file
# ---------- output_steel_file_to_json: Python ----------
__author__ = "giada"
__version__ = "2022.09.07"

import rhinoscriptsyntax as rs
import json

def export_to_json(filepath, data):
    with open(filepath, 'w') as jsonfile:
        json.dump(data, jsonfile, ensure_ascii=False, indent=4)

# dictionary
steel = {
    'id': name if name is not None else' ',
    'fy': int(fy) * 1000,
    'fu': int(fu) * 1000,
    'E': int(E) * 1000,
    'epsilon_u': float(epsilon_u)
}


export_to_json(
    path,
    steel
)

output_file = path
# ---------- end output_steel_file_to_json ----------
output_timber_file_to_json = GhPythonScript(name="laminated timber", fc=f_bending_mpa, E=e_timber_mpa, G=g_timber_mpa, Eperp=e_timber_perp_mpa, path=path_timber)  # -> console, dict_json, output_file
# ---------- output_timber_file_to_json: Python ----------
__author__ = "giada"
__version__ = "2022.09.07"

import rhinoscriptsyntax as rs
import json

def export_to_json(filepath, data):
    with open(filepath, 'w') as jsonfile:
        json.dump(data, jsonfile, ensure_ascii=False, indent=4)

# dictionary
if name is None:
    name = " "
timber = {
    'id': name,
    'fc': float(fc) * 1000,
    'E': float(E) * 1000,
    'G': int(G) * 1000,
    'Eperp': int(Eperp) * 1000
}



export_to_json(
    path,
    timber
)

output_file = path
# ---------- end output_timber_file_to_json ----------
output_tendon_file_to_json = GhPythonScript(
    name="post-tensioned strands",
    fy=f_pt_mpa,
    fu=f_pt_u_mpa,
    E=e_steel_mpa,
    A=a_pt_mmq,
    epsilon_u=e_ultimate_pt,
    path=path_tendon)  # -> console, dict_json, output_file
# ---------- output_tendon_file_to_json: Python ----------
__author__ = "giada"
__version__ = "2022.09.07"

import rhinoscriptsyntax as rs
import json

def export_to_json(filepath, data):
    with open(filepath, 'w') as jsonfile:
        json.dump(data, jsonfile, ensure_ascii=False, indent=4)

# dictionary
tendon = {
    'id': name if name is not None else' ',
    'fy': int(fy) * 1000,
    'fu': int(fu) * 1000,
    'E': int(E) * 1000,
    'A': float(A)/1000000,
    'epsilon_u': float(epsilon_u)
}


export_to_json(
    path,
    tendon
)

output_file = path
# ---------- end output_tendon_file_to_json ----------
panel_13 = Panel(output_tendon_file_to_json.output_file)
panel_14 = Panel(output_steel_file_to_json.output_file)
panel_15 = Panel(output_timber_file_to_json.output_file)
modal_analysis = GhPythonScript(
    repo_path=path_code,
    frame_path=path_frame,
    timber_path=path_timber,
    steel_path=path_steel,
    tendon_path=path_tendon,
    run=Toggle(False))  # -> console, structure_periods
# ---------- modal_analysis: Python ----------
__author__ = "giada"
__version__ = "2022.09.07"

import rhinoscriptsyntax as rs
import csv
import subprocess
import os

#print(repo_path)

# Replace with the correct path to your virtual environment's python
modal_output = repo_path + "output\\modal.csv"
venv_python = repo_path + ".venv\\Scripts\\python.exe"
script_path = repo_path + "run_modal.py"

script_dir = os.path.dirname(script_path)

args = [
    "-frame", frame_path,
    "-timber", timber_path,
    "-steel", steel_path,
    "-tendon", tendon_path
    ]

structure_periods = []

if run:
    process = subprocess.call([venv_python, os.path.basename(script_path)] + args, cwd=script_dir)
#    print(venv_python + " " + script_path + " " + " ".join(args))
    with open(modal_output) as csvfile:
        reader = csv.DictReader(csvfile)
        for row in reader:
            value = row.get('structure_periods')
            if value:  # skip empty values
                structure_periods.append(float(value))
            
    print(structure_periods)
# ---------- end modal_analysis ----------

# ----
fema_input = GhPythonScript(
    repo_path=path_code,
    frame_path=path_frame,
    timber_path=path_timber,
    steel_path=path_steel,
    tendon_path=path_tendon,
    timehistory_path=path_th,
    waveforms_path=path_waveforms,
    intensities_path=path_intensities,
    output_path=path_output_fema,
    run=Toggle(False))  # -> console, output_path
# ---------- fema_input: Python ----------
__author__ = "giada"
__version__ = "2022.09.07"

import rhinoscriptsyntax as rs
import csv
import subprocess
import os


# Replace with the correct path to your virtual environment's python
venv_python = repo_path + ".venv\\Scripts\\python.exe"
script_path = repo_path + "run_fema.py"


script_dir = os.path.dirname(script_path)


args = [
    "-frame", frame_path,
    "-timber", timber_path,
    "-steel", steel_path,
    "-tendon", tendon_path,
    "-th", timehistory_path,
    "-waveforms", waveforms_path,
    "-intensities", intensities_path,
    "-output", output_path
    ]

if run:
    process = subprocess.call([venv_python, os.path.basename(script_path)] + args, cwd=script_dir)
    print(venv_python + " " + script_path + " " + " ".join(args))
    output_path = output_path
# ---------- end fema_input ----------
time_history = GhPythonScript(
    repo_path=path_code,
    frame_path=path_frame,
    timber_path=path_timber,
    steel_path=path_steel,
    tendon_path=path_tendon,
    timehistory_path=path_th,
    waveforms_path=path_waveforms,
    run=Toggle(False))  # -> console, output_path
# ---------- time_history: Python ----------
__author__ = "giada"
__version__ = "2022.09.07"

import rhinoscriptsyntax as rs
import csv
import subprocess
import os

print(repo_path)

# Replace with the correct path to your virtual environment's python
timehistory_output = repo_path + "output\\cloud_data.hdf5"
venv_python = repo_path + ".venv\\Scripts\\python.exe"
script_path = repo_path + "run_timehistory.py"

script_dir = os.path.dirname(script_path)

args = [
    "-frame", frame_path,
    "-timber", timber_path,
    "-steel", steel_path,
    "-tendon", tendon_path,
    "-th", timehistory_path,
    "-waveforms", waveforms_path
    ]

if run:
    process = subprocess.call([venv_python, os.path.basename(script_path)] + args, cwd=script_dir)
    output_path = timehistory_output
# ---------- end time_history ----------
panel_16 = Panel(fema_input.output_path)
panel_17 = Panel(time_history.output_path)
panel_18 = Panel(modal_analysis.structure_periods)

# ---- group: ENERGY PERFORMANCE
# seismic/energy common parameters
# energy-specific parameters
# Window to Wall Ratio
# Conditioned Y/N
# Cutom Building Program
# EPW File Directory
# DDY Folder Directory
bldgprograms = HBBuildingPrograms({"LargeOffice", "MediumOffice", "SmallOffice", "MidriseApartment", "HighriseApartment", "Retail", "StripMall", "PrimarySchool", "SecondarySchool", "SmallHotel", "LargeHotel", "Hospital", "Outpatient", "Laboratory", "Warehouse", "SuperMarket", "FullServiceRestaurant", "QuickServiceRestaurant", "Courthouse", "College", "LargeDataCenterHighITE", "LargeDataCenterLowITE", "SmallDataCenterHighITE", "SmallDataCenterLowITE"}, selected="MediumOffice")
footprint = Footprint(
    l_seismic_span=l_seismic_span,
    l_gravity_span=l_gravity_span,
    n_seismic_spans=n_seismic_spans,
    n_gravity_spans=n_gravity_spans,
    h_column=column_h,
    b_column=column_b,
    facade_thickness=division_21)  # -> zone_parameter_west, zone_parameter_east, yaxis, zone_corner_south, xaxis, zone_corner_north, zone_rest, footprint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
window_to_wall_ratio = Panel("0.3")
toggle = BooleanToggle(False)
program_type = Data(bldgprograms)
weather_file = FilePath("C:\Users\kyujinkimkim\OneDrive - Delft University of Technology\Desktop\wp6_parametric\EPW_acerra\16289034113_2021.epw")
path = FilePath("C:\Users\kyujinkimkim\OneDrive - Delft University of Technology\Desktop\wp6_parametric\EPW_acerra\")
room2dattr = DFRoom2DAttributes({"Display Name": "display_name", "Simulation Name (Identifier)": "identifier", "Floor-To-Ceiling Height": "floor_to_ceiling_height", "Floor Elevation": "floor_height", "Ceiling Elevation": "ceiling_height", "Is Ground Contact": "is_ground_contact"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}, selected="Display Name")

room2d = DFRoom2D(
    geo=flatten(footprint.zone_corner_north),
    flr_to_ceiling=h_interstorey,
    name="corner_north",
    program=program_type,
    conditioned=toggle)  # -> report, room2d; plug-in component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
room2d_2 = DFRoom2D(
    geo=flatten(footprint.zone_corner_south),
    flr_to_ceiling=h_interstorey,
    name="corner_south",
    program=program_type,
    conditioned=toggle)  # -> report, room2d; plug-in component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
room2d_3 = DFRoom2D(
    geo=flatten(footprint.zone_parameter_east),
    flr_to_ceiling=h_interstorey,
    name="parameter_east",
    program=program_type,
    conditioned=toggle)  # -> report, room2d; plug-in component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
room2d_4 = DFRoom2D(
    geo=flatten(footprint.zone_parameter_west),
    flr_to_ceiling=h_interstorey,
    name="parameter_west",
    program=program_type,
    conditioned=toggle)  # -> report, room2d; plug-in component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
room2d_5 = DFRoom2D(
    geo=flatten(footprint.zone_parameter_north),
    flr_to_ceiling=h_interstorey,
    name="parameter_north",
    program=program_type,
    conditioned=toggle)  # -> report, room2d; plug-in component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
room2d_6 = DFRoom2D(
    geo=flatten(footprint.zone_parameter_south),
    flr_to_ceiling=h_interstorey,
    name="parameter_south",
    program=program_type,
    conditioned=toggle)  # -> report, room2d; plug-in component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
room2d_7 = DFRoom2D(geo=flatten(footprint.zone_rest), flr_to_ceiling=h_interstorey, name="rest", program=program_type, conditioned=toggle)  # -> report, room2d; plug-in component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
facparam = HBFacadeParameters(north=window_to_wall_ratio, east=0, south=0, west=0)  # -> fac_par; plug-in component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
facparam_2 = HBFacadeParameters(north=0, east=0, south=window_to_wall_ratio, west=0)  # -> fac_par; plug-in component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
facparam_3 = HBFacadeParameters(north=0, east=window_to_wall_ratio, south=0, west=0)  # -> fac_par; plug-in component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
facparam_4 = HBFacadeParameters(north=0, east=0, south=0, west=window_to_wall_ratio)  # -> fac_par; plug-in component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
facparam_5 = HBFacadeParameters(north=window_to_wall_ratio, east=0, south=0, west=0)  # -> fac_par; plug-in component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
facparam_6 = HBFacadeParameters(north=0, east=0, south=window_to_wall_ratio, west=0)  # -> fac_par; plug-in component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
simpleratiopar = DFSimpleWindowRatioParameters(ratio=facparam)  # -> win_par; plug-in component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
simpleratiopar_2 = DFSimpleWindowRatioParameters(ratio=facparam_2)  # -> win_par; plug-in component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
simpleratiopar_3 = DFSimpleWindowRatioParameters(ratio=facparam_3)  # -> win_par; plug-in component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
simpleratiopar_4 = DFSimpleWindowRatioParameters(ratio=facparam_4)  # -> win_par; plug-in component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
simpleratiopar_5 = DFSimpleWindowRatioParameters(ratio=facparam_5)  # -> win_par; plug-in component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
simpleratiopar_6 = DFSimpleWindowRatioParameters(ratio=facparam_6)  # -> win_par; plug-in component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
applyfacadepar = DFApplyFacadeParameters(df_obj=flatten(room2d.room2d), win_par=simpleratiopar)  # -> report, flatten(df_obj); plug-in component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
applyfacadepar_2 = DFApplyFacadeParameters(df_obj=flatten(room2d_2.room2d), win_par=simpleratiopar_2)  # -> report, df_obj; plug-in component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
applyfacadepar_3 = DFApplyFacadeParameters(df_obj=flatten(room2d_3.room2d), win_par=simpleratiopar_3)  # -> report, df_obj; plug-in component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
applyfacadepar_4 = DFApplyFacadeParameters(df_obj=flatten(room2d_4.room2d), win_par=simpleratiopar_4)  # -> report, df_obj; plug-in component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
applyfacadepar_5 = DFApplyFacadeParameters(df_obj=flatten(room2d_5.room2d), win_par=simpleratiopar_5)  # -> report, df_obj; plug-in component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
applyfacadepar_6 = DFApplyFacadeParameters(df_obj=flatten(room2d_6.room2d), win_par=simpleratiopar_6)  # -> report, df_obj; plug-in component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
entwine = Entwine(
    Branch00=applyfacadepar.df_obj,
    Branch01=applyfacadepar_2.df_obj,
    Branch02=applyfacadepar_3.df_obj,
    Branch03=applyfacadepar_4.df_obj,
    Branch04=applyfacadepar_5.df_obj,
    Branch05=applyfacadepar_6.df_obj,
    Branch06=room2d_7.room2d,
    FlattenInputs=True)  # -> flatten(Result)

# ---- group: ENERGY PERFORMANCE / Output Parameters
toggle_2 = BooleanToggle(True)
epwtoddy = LBEPWToDDY(weather_file=weather_file, folder=path, write=Toggle(True))  # -> ddy_file; plug-in component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
simoutput = HBSimulationOutput(gains_and_losses=toggle_2, comfort_metrics=toggle_2, surface_temperature=toggle_2)  # -> report, sim_output; plug-in component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
sizingpar = HBSizingParameter(ddy_file=epwtoddy)  # -> sizing; plug-in component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
simpar = HBSimulationParameter(output=simoutput.sim_output, timestep=6, sizing=sizingpar)  # -> sim_par; plug-in component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

# ---- group: ENERGY PERFORMANCE / Dragonfly to Honeybee
room2dattr_2 = DFRoom2DAttributes({"Display Name": "display_name", "Simulation Name (Identifier)": "identifier", "Floor-To-Ceiling Height": "floor_to_ceiling_height", "Floor Elevation": "floor_height", "Ceiling Elevation": "ceiling_height", "Is Ground Contact": "is_ground_contact"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}, selected="Floor Elevation")
room2dsbyattr = DFRoom2DsByAttribute(df_obj=flatten(entwine), attribute=room2dattr_2)  # -> values, room2ds; plug-in component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
toggle_3 = BooleanToggle(True)
introom2d = DFIntersectRoom2Ds(room2ds=room2dsbyattr.room2ds, run=toggle_3)  # -> int_room2ds; plug-in component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
solveadj2d = DFSolveAdjacency(df_objs=introom2d, run=toggle_3)  # -> report, df_objs; plug-in component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

# ---- group: ENERGY PERFORMANCE / Natural Ventilation
ventcontrol = HBVentilationControl(min_in_temp="20", max_in_temp="100", min_out_temp="15", max_out_temp="100")  # -> vent_cntrl; plug-in component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
dfwindowopen = DFWindowOpening(df_objs=flatten(solveadj2d.df_objs), vent_cntrl=ventcontrol)  # -> report, df_objs; plug-in component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

# ---- group: ENERGY PERFORMANCE / Dragonfly to Honeybee (continued)
story = DFStory(room2ds=dfwindowopen.df_objs, name="floor", multiplier=n_storey)  # -> report, story; plug-in component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
buildingstories = DFBuildingFromStories(stories=story.story, name="building", constr_set=constructionset)  # -> report, building; plug-in component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
topbottom = DFSeparateTopBottom(buildings=flatten(buildingstories.building))  # -> buildings; plug-in component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
model = DFModel(buildings=flatten(topbottom), name="multizone")  # -> report, model; plug-in component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
tohoneybee = DFModelToHoneybee(model=model.model, use_multiplier=Toggle(False), run=Toggle(True))  # -> report, hb_models; plug-in component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

# ---- group: ENERGY PERFORMANCE / Create IDF file
write_idf = Panel("2")
path_2 = FilePath("C:\Users\kyujinkimkim\OneDrive - Delft University of Technology\Desktop\wp6_parametric\IDF_multizone\")
modeltoosm = HBModelToOSM(model=tohoneybee.hb_models, epw_file=weather_file, sim_par=simpar, folder=path_2, write=Toggle(False), run=write_idf)  # -> report, jsons, osw, osm, idf, sql, zsz, rdd, html; plug-in component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
panel_19 = Panel(modeltoosm.idf)

# ---- group: ENERGY PERFORMANCE (continued)
labelrooms = HBLabelRooms(rooms_model=flatten(tohoneybee.hb_models), attribute=room2dattr, txt_height="0.4")  # -> label_text, base_pts, labels, wire_frame; plug-in component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
vizbytype = HBVisualizeByType(hb_objs=tohoneybee.hb_models)  # -> walls, interior_walls, roofs, ceilings, exterior_floors, interior_floors, air_walls, apertures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; plug-in component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
brep = Brep(vizbytype.wire_frame)
mesh = Mesh(vizbytype.interior_walls)

# ==== cluster _3DCOLUMNS
h_column = ClusterInput()
b_column = ClusterInput()
l_seismic_span = ClusterInput()
l_gravity_span = ClusterInput()
n_seismic_spans = ClusterInput()
n_gravity_spans = ClusterInput()
h_interstorey = ClusterInput()
n_storey = ClusterInput()

# ---- group: COLUMNS
recgrid = Rectangular(
    Plane=PlaneXY(0, 0, 0),
    LSeismicSpan=l_seismic_span,
    LGravitySpan=l_gravity_span,
    NSeismicSpans=n_seismic_spans,
    NGravitySpans=n_gravity_spans)  # -> Cells, GRIDCOLUMNS
multiplication = Multiplication(HInterstorey=h_interstorey, NStorey=n_storey)
rectangle = Rectangle(Plane=PlaneXY(0, 0, 0), HColumn=h_column, BColumn=b_column, Radius=0)  # -> Rectangle, Length
division = Division(BColumn=b_column, B="2")
division_2 = Division(HColumn=h_column, B="2")
move = Move(Geometry=rectangle.Rectangle, Motion=recgrid.GRIDCOLUMNS)  # -> Geometry, Transform
vec = VectorXYZ(XComponent=division_2, YComponent=division, ZComponent=0)  # -> Vector, Length
rev = Reverse(Vector=vec.Vector)
move_2 = Move(Geometry=move.Geometry, Motion=rev)  # -> Geometry, Transform
boxrec = BoxRectangle(Rectangle=move_2.Geometry, Height=multiplication)  # -> simplify(flatten(COLUMNS))

# ----
grid_columns = ClusterOutput(recgrid.GRIDCOLUMNS)
columns = ClusterOutput(boxrec)

# ==== cluster _3DGRAVITYBEAMS
columns_grid = ClusterInput()
b_gravity_beam = ClusterInput()
l_gravity_beam = ClusterInput()
n_gravity_spans = ClusterInput()
h_gravity_beam = ClusterInput()
slab_thickness = ClusterInput()
h_floor = ClusterInput()
columns = ClusterInput()

# ---- group: GRAVITY BEAMS
xz = XZPlane(Origin=Point(0, 0, 0))
addition = Addition(HGravityBeam=h_gravity_beam, SlabThickness=slab_thickness)
multiplication = Multiplication(LGravityBeam=l_gravity_beam, NGravitySpans=n_gravity_spans)
division = Division(BGravityBeam=b_gravity_beam, B="2")
rectangle = Rectangle(Plane=xz, BGravityBeam=b_gravity_beam, HGravityBeam=h_gravity_beam, Radius=0)  # -> Rectangle, Length
item = ListItem(COLUMNSGRID=simplify(columns_grid), Index="-1", Wrap=True)
subtraction = Subtraction(A=h_floor, B=addition)
X = UnitX(Factor=division)
Z = UnitZ(Factor=subtraction)
move = Move(Geometry=rectangle.Rectangle, Motion=item)  # -> Geometry, Transform
rev = Reverse(Vector=X)
move_2 = Move(Geometry=move.Geometry, Motion=Z)  # -> Geometry, Transform
move_3 = Move(Geometry=move_2.Geometry, Motion=rev)  # -> Geometry, Transform
boxrec = BoxRectangle(Rectangle=move_3.Geometry, Height=multiplication)  # -> simplify(Box)
sdiff = SolidDifference(BrepsA=boxrec, BrepsB=columns)

# ----
gravity_beams = ClusterOutput(sdiff)

# ==== cluster _3DSEISMICBEAMS
columns_grid = ClusterInput()
h_floor = ClusterInput()
h_seismic_beam = ClusterInput()
b_seismic_beam = ClusterInput()
l_span = ClusterInput()
n_spans = ClusterInput()
seismic_frames = ClusterInput()
columns = ClusterInput()

# ---- group: SEISMIC BEAMS
subtraction = Subtraction(HFloor=h_floor, HSeismicBeam=h_seismic_beam)
branch = TreeBranch(COLUMNSGRID=simplify(columns_grid), Path="{0}", MaintainPaths=True)
yz = YZPlane(Origin=Point(0, 0, 0))
division = Division(BSeismicBeam=b_seismic_beam, B="2")
multiplication = Multiplication(LSpan=l_span, NSpans=n_spans)
Z = UnitZ(Factor=subtraction)
rectangle = Rectangle(Plane=yz, BSeismicBeam=b_seismic_beam, HSeismicBeam=h_seismic_beam, Radius=0)  # -> Rectangle, Length
item = ListItem(List=branch, SEISMICFRAMES=seismic_frames, Wrap=True)  # -> simplify(graft(Item))
Y = UnitY(Factor=division)
rev = Reverse(Vector=Y)
move = Move(Geometry=rectangle.Rectangle, Motion=item)  # -> Geometry, Transform
move_2 = Move(Geometry=move.Geometry, Motion=Z)  # -> Geometry, Transform
move_3 = Move(Geometry=move_2.Geometry, Motion=rev)  # -> simplify(Geometry), Transform
boxrec = BoxRectangle(Rectangle=move_3.Geometry, Height=multiplication)
sdiff = SolidDifference(BrepsA=boxrec, BrepsB=columns)

# ----
seismic_beams = ClusterOutput(sdiff)

# ==== cluster _3DWALLS
l_seismic_span = ClusterInput()
n_seismic_spans = ClusterInput()
n_gravity_spans = ClusterInput()
b_gravity_beam = ClusterInput()
b_wall = ClusterInput()
l_gravity_span = ClusterInput()
l_wall = ClusterInput()
h_interstorey = ClusterInput()
n_floor = ClusterInput()

# ---- group: WALLS
multiplication = Multiplication(LSeismicSpan=l_seismic_span, NSeismicSpans=n_seismic_spans)
addition = Addition(BGravityBeam=b_gravity_beam, BWall=b_wall)
subtraction = Subtraction(NGravitySpans=n_gravity_spans, B="1")
division = Division(BGravityBeam=b_gravity_beam, B="2")
division_2 = Division(LGravitySpan=l_gravity_span, B="2")
multiplication_2 = Multiplication(HInterstorey=h_interstorey, NFloor=n_floor)
addition_2 = Addition(A=multiplication, B=addition)
division_3 = Division(LWall=l_wall, B="2")
recgrid = Rectangular(Plane=PlaneXY(0, 0, 0), SizeX=addition_2, LGravitySpan=l_gravity_span, ExtentX="1", ExtentY=subtraction)  # -> Cells, Points
addition_3 = Addition(A=division, BWall=b_wall)
subtraction_2 = Subtraction(A=division_2, B=division_3)
rectangle = Rectangle(Plane=PlaneXY(0, 0, 0), XSize=b_wall, YSize=l_wall, Radius=0)  # -> Rectangle, Length
X = UnitX(Factor=addition_3)
Y = UnitY(Factor=subtraction_2)
move = Move(Geometry=rectangle.Rectangle, Motion=recgrid.Points)  # -> Geometry, Transform
rev = Reverse(Vector=X)
move_2 = Move(Geometry=move.Geometry, Motion=rev)  # -> Geometry, Transform
move_3 = Move(Geometry=move_2.Geometry, Motion=Y)  # -> Geometry, Transform
panel = Panel("""{0;0;0}
{0;0;1}""")
panel_2 = Panel("""0
-1""")
item = TreeItem(Tree=move_3.Geometry, Path=graft(panel), Index=panel_2, Wrap=True)
boxrec = BoxRectangle(Rectangle=item, Height=multiplication_2)

# ----
walls = ClusterOutput(boxrec)

# ==== cluster _3DCONCRETESLAB
b_gravity_beam = ClusterInput()
thickness_slab = ClusterInput()
l_seismic_span = ClusterInput()
n_seismic_spans = ClusterInput()
thickness_slab_2 = ClusterInput()
l_gravity_span = ClusterInput()
n_gravity_spans = ClusterInput()
h_floor = ClusterInput()
seismic_beams = ClusterInput()
columns = ClusterInput()

# ---- group: CONCRETE SLABS
multiplication = Multiplication(LSeismicSpan=l_seismic_span, NSeismicSpans=n_seismic_spans)
multiplication_2 = Multiplication(LGravitySpan=l_gravity_span, NGravitySpans=n_gravity_spans)
subtraction = Subtraction(HFloor=h_floor, ThicknessSlab=thickness_slab_2)
addition = Addition(A=multiplication, B=b_gravity_beam)
rectangle = Rectangle(Plane=PlaneXY(0, 0, 0), XSize=addition, YSize=multiplication_2, Radius=0)  # -> Rectangle, Length
division = Division(BGravityBeam=b_gravity_beam, B="2")
Z = UnitZ(Factor=subtraction)
boxrec = BoxRectangle(Rectangle=rectangle.Rectangle, ThicknessSlab=thickness_slab)
X = UnitX(Factor=division)
move = Move(Geometry=boxrec, Motion=Z)  # -> Geometry, Transform
rev = Reverse(Vector=X)
move_2 = Move(Geometry=move.Geometry, Motion=rev)  # -> Geometry, Transform
sdiff = SolidDifference(BrepsA=move_2.Geometry, BrepsB=columns)
sdiff_2 = SolidDifference(BrepsA=sdiff, SEISMICBEAMS=flatten(seismic_beams))

# ----
concrete_slabs = ClusterOutput(sdiff_2)

# ==== cluster _3DTCCFLOORS
l_seismic_span = ClusterInput()
n_seismic_spans = ClusterInput()
l_gravity_span = ClusterInput()
n_gravity_spans = ClusterInput()
h_floor = ClusterInput()
thickness_timber_slab = ClusterInput()
thickness_slab = ClusterInput()
B = ClusterInput()
gravity_beams = ClusterInput()
seismic_beams = ClusterInput()
columns = ClusterInput()

# ---- group: TIMBER FLOORS
multiplication = Multiplication(LSeismicSpan=l_seismic_span, NSeismicSpans=n_seismic_spans)
subtraction = Subtraction(HFloor=h_floor, ThicknessTimberSlab=thickness_timber_slab, ThicknessSlab=thickness_slab)
multiplication_2 = Multiplication(LGravitySpan=l_gravity_span, NGravitySpans=n_gravity_spans)
addition = Addition(A=multiplication, B=B)
rectangle = Rectangle(Plane=PlaneXY(0, 0, 0), XSize=addition, YSize=multiplication_2, Radius=0)  # -> Rectangle, Length
division = Division(BGravityBeam=B, B="2")
boxrec = BoxRectangle(Rectangle=rectangle.Rectangle, ThicknessTimberSlab=thickness_timber_slab)
Z = UnitZ(Factor=subtraction)
X = UnitX(Factor=division)
move = Move(Geometry=boxrec, Motion=Z)  # -> Geometry, Transform
rev = Reverse(Vector=X)
move_2 = Move(Geometry=move.Geometry, Motion=rev)  # -> Geometry, Transform
sdiff = SolidDifference(BrepsA=move_2.Geometry, BrepsB=columns)
sdiff_2 = SolidDifference(BrepsA=sdiff, GRAVITYBEAMS=flatten(gravity_beams))
sdiff_3 = SolidDifference(BrepsA=sdiff_2, SEISMICBEAMS=flatten(seismic_beams))

# ----
timber_floors = ClusterOutput(sdiff_3)

# ==== cluster Footprint
h_column = ClusterInput()
b_column = ClusterInput()
facade_thickness = ClusterInput()
l_seismic_span = ClusterInput()
l_gravity_span = ClusterInput()
n_seismic_spans = ClusterInput()
n_gravity_spans = ClusterInput()

# ---- group: COLUMNS
recgrid = Rectangular(
    Plane=PlaneXY(0, 0, 0),
    LSeismicSpan=l_seismic_span,
    LGravitySpan=l_gravity_span,
    NSeismicSpans=n_seismic_spans,
    NGravitySpans=n_gravity_spans)  # -> Cells, GRIDCOLUMNS
rectangle = Rectangle(Plane=PlaneXY(0, 0, 0), HColumn=h_column, BColumn=b_column, Radius=0)  # -> Rectangle, Length
division = Division(BColumn=b_column, B="2")
division_2 = Division(HColumn=h_column, B="2")
move = Move(Geometry=rectangle.Rectangle, Motion=recgrid.GRIDCOLUMNS)  # -> Geometry, Transform
vec = VectorXYZ(XComponent=division_2, YComponent=division, ZComponent=0)  # -> Vector, Length
rev = Reverse(Vector=vec.Vector)
move_2 = Move(Geometry=move.Geometry, Motion=rev)  # -> Geometry, Transform

# ----
debrep = DeconstructBrep(Brep=move_2.Geometry)  # -> Faces, Edges, Vertices
pt = Point(recgrid.GRIDCOLUMNS)
hull2d = ConvexHull(Points=flatten(debrep.Vertices), Plane=PlaneXY(0, 0, 0))  # -> Hull, HullZ, Indices
flip = FlipMatrix(Data=pt)
pline = PolyLine(Vertices=pt, Closed=False)
pline_2 = PolyLine(Vertices=flip, Closed=False)
offset = OffsetCurve(Curve=hull2d.Hull, Distance=facade_thickness, Corners=1)
addition = Addition(A=facade_thickness, B=division)
addition_2 = Addition(A=facade_thickness, B=division_2)
crv = Curve(hull2d.Hull)
ext = ExtendCurve(Curve=pline, Type=0, Start=addition, End=addition)  # -> flatten(Curve)
ext_2 = ExtendCurve(Curve=pline_2, Type=0, Start=addition_2, End=addition_2)  # -> flatten(Curve)
brep = Brep(offset)
panel = Panel("""0
-1""")
cull_i = CullIndex(List=ext, Indices=panel, Wrap=True)  # -> flatten(List)
cull_i_2 = CullIndex(List=ext_2, Indices=panel, Wrap=True)  # -> flatten(List)
srfsplit = SurfaceSplit(Surface=brep, Curves=[cull_i_2, cull_i])  # -> flatten(Fragments)
yaxis = ClusterOutput(cull_i)
footprint = ClusterOutput(offset)
xaxis = ClusterOutput(cull_i_2)

# ---- group: sort order of srf
area = Area(Geometry=srfsplit)  # -> Area, Centroid
pdecon = Deconstruct(Point=<missing>)  # -> expr("X*1000", XComponent), YComponent, ZComponent
addition_3 = Addition(A=pdecon.XComponent, B=pdecon.YComponent)
sort = SortList(Keys=addition_3, ValuesA=srfsplit, ValuesB=<missing>)  # -> Keys, ValuesA, ValuesB
points = PointList(Points=sort.ValuesB, Size=Slider(1, range=0..1))

# ----
floorplan = ClusterOutput(sort.ValuesA)

lng = ListLength(List=cull_i_2)
lng_2 = ListLength(List=cull_i)
addition_4 = Addition(A=lng, B="1")
addition_5 = Addition(A=lng_2, B="1")
series = Series(Start="0", Step=addition_4, Count=addition_5)
panel_2 = Panel("""0
-1""")
cull_i_3 = CullIndex(List=series, Indices=panel_2, Wrap=True)
item = ListItem(List=sort.ValuesA, Index=cull_i_3, Wrap=True)

zone_parameter_south = ClusterOutput(item)

lng_3 = ListLength(List=srfsplit)
lng_4 = ListLength(List=cull_i_2)
subtraction = Subtraction(A=lng_3, B="1")
subtraction_2 = Subtraction(A=subtraction, B=lng_4)

lng_5 = ListLength(List=cull_i_2)
addition_6 = Addition(A="0", B=lng_5)
merge = Merge(Data1="0", Data2=subtraction_2)
item_2 = ListItem(List=sort.ValuesA, Index=merge, Wrap=True)

merge_2 = Merge(Data1=addition_6, Data2=subtraction)
item_3 = ListItem(List=sort.ValuesA, Index=merge_2, Wrap=True)

zone_corner_south = ClusterOutput(item_2)
zone_corner_north = ClusterOutput(item_3)

addition_7 = Addition(A="0", B="1")
subtraction_3 = Subtraction(A=addition_6, B="1")
subtraction_4 = Subtraction(A=subtraction_3, B=addition_7, C="-1")
series_2 = Series(Start=addition_7, Step=1, Count=subtraction_4)
item_4 = ListItem(List=sort.ValuesA, Index=series_2, Wrap=True)

addition_8 = Addition(A=subtraction_2, B="1")
subtraction_5 = Subtraction(A=subtraction, B="1")
subtraction_6 = Subtraction(A=subtraction_5, B=addition_8, C="-1")
series_3 = Series(Start=addition_8, Step=1, Count=subtraction_6)
item_5 = ListItem(List=sort.ValuesA, Index=series_3, Wrap=True)

lng_6 = ListLength(List=cull_i_2)
lng_7 = ListLength(List=cull_i)
addition_9 = Addition(A=lng_6, B="1")
addition_10 = Addition(A=lng_7, B="1")
series_4 = Series(Start=addition_6, Step=addition_9, Count=addition_10)
panel_3 = Panel("""0
-1""")
cull_i_4 = CullIndex(List=series_4, Indices=panel_3, Wrap=True)
item_6 = ListItem(List=sort.ValuesA, Index=cull_i_4, Wrap=True)

zone_parameter_north = ClusterOutput(item_6)
zone_parameter_west = ClusterOutput(item_4)
zone_parameter_east = ClusterOutput(item_5)
cull_i_5 = CullIndex(List=sort.ValuesA, Indices=flatten([merge_2, merge, series_2, series_3, cull_i_3, cull_i_4]), Wrap=True)
zone_rest = ClusterOutput(cull_i_5)
